# Grasshopper definition metrics_new.gh (Grasshopper 1.0.7)
# plug-ins: ScriptParasite, Human, Kangaroo2 Components

# Layout Curves:
# 
# The curves that bound your layout.
# A curve usually corresponds to a wall.
# Make sure that all curves are closed and joined as much as possible.
# Reference Line and Real Units:
# 
# Set "Reference Line" to a line in a building whose length you know
# (for example by inspecting the floorplan).
# Set "Real Units" to the length of that line in the layout.
# Setting it to "4.00" means that "Reference Line" has a length of 4 m in the real layout.
layout_curves = Curve([<curve referenced from the Rhino model> x72])
# Boundary Proximity Tolerance:
# 
# How close the medial axis is able to approach the boundary (in Rhino units).
boundary_proximity_tolerance = Slider(5, range=0..100)

# ----
# Isovist Sample Distance:
# 
# Describes after how many Rhino units on a path a new Isovist is calculated for the SCI.
# Example: Consider a path connecting two patient rooms.
# Let's say this path is 10 Rhino units long.
# If we set "Isovist Sample Distance" to 2,
# then the script will sample 6 isovists along this path:
# At 0, 2, 4, ..., 10 units.
# Thus, lowering this value will increase the number of isovist calculated,
# and therefore increase the load on your system.
isovist_sample_distance = Slider(100, range=0.1..1000)

# ----
# Number of Beds per Patient Room:
# 
# Used to properly weight the SCI value.
# Set it to the average number of beds per patient room.
# Graph Construction
# In the following parameters you set the nodes
# and edges of the graph.
# Note that for the script to function properly,
# all parameters have to be populated.
number_of_beds_per_patient_room = Number(2)

# ----
# Nodes:
# 
# Each node corresponds to a location in the building.
patient_room = Point([<point referenced from the Rhino model> x70])
nurse_station = Point([<point referenced from the Rhino model> x4])
utility_room = Point(<point referenced from the Rhino model>)
elevator = Point([<point referenced from the Rhino model> x9])
elevator_lobby = Point([<point referenced from the Rhino model> x3])
medical_clinic = Point(<point referenced from the Rhino model>)
pantry = Point([<point referenced from the Rhino model> x3])
medication_room = Point(<point referenced from the Rhino model>)
janitor_closet = Point(<point referenced from the Rhino model>)
additional = Point([<point referenced from the Rhino model> x33])

# ----
# Edges:
# 
# The edges represent direct spatial adjacency of two nodes.
# This means there should only be an edge between two nodes
# if they are directly reachable (without passing through other nodes)
# from each other.
# Visualization
# With the following parameters,
# you can toggle on and off different visualizations
# and change specific visualizations parameters.
edges = Curve([<curve referenced from the Rhino model> x33])

# ----
# Medial Axis:
# 
# The medial axis of a shape are all the points
# that are equidistant (exactly equally far apart)
# from a set of points on it boundary.
# 
# It can be seen as the "skeleton" of a shape and
# uniquely describes any shape.
visualize_medial_axis = BooleanToggle(True)
medial_axis_color = ColourSwatch(SwatchColor=RGB(128, 0, 0))
medial_axis_weight = Slider(4, range=0..10)

# ----
# Walkable Surface:
# 
# The floor of your layout.
visualize_walkable_surface = BooleanToggle(True)
walkable_surface_color = ColourSwatch(SwatchColor=RGB(0, 0, 0))

explode = Explode(Curve=layout_curves, Recursive=True)  # -> reparameterize(flatten(Segments)), Vertices

# ---- group: Coloring Boundary
material = CreateMaterial(
    Diffuse=ColourSwatch(SwatchColor=RGB(0, 0, 0)),
    Specular=RGB(255, 255, 255),
    Emission=RGB(0, 0, 0),
    Transparency=0,
    Shine=0)
previewlw = CustomPreviewLineweights(Geometry=layout_curves, Shader=material, Thickness=Slider(5, range=0..100), Absolute=False)

# ---- group: Script Editor Synchronization
toggle = BooleanToggle(True)
panel = Panel("C:\Users\rapha\Documents\ebdwebsite.github.io\toolkit\scripts")

# ---- group: Boundary Subdivision (Fast)
number_slider = Slider(5, range=0..10)
len = Length(Curve=explode.Segments)
division = Division(A=len, B=number_slider)
eval = Evaluate(F="floor(x)", x=division)
divide = DivideCurve(Curve=explode.Segments, Count=eval, Kinks=False)  # -> flatten(Points), Tangents, Parameters

# ----
synchronization_enabled = Boolean(toggle)
script_directory = Text(panel)

scriptpar = ScriptParasite(Enable=synchronization_enabled, Folder=script_directory)
pairwisesplitting = CSharpScript(Segments=explode.Segments)  # -> out, PairwiseSplitSegments; inputs Segments: list of Curve
# ---------- pairwisesplitting: C# usings ----------
using Rhino.Geometry.Intersect;
# ---------- pairwisesplitting: C# ----------
    List<Curve> pairwiseSplitCurves = new List<Curve>();
    foreach (Curve seg0 in Segments)
    {
      List<double> splitParams = new List<double>();
      foreach (Curve seg1 in Segments)
      {
        if (seg0 == seg1)
        {
          continue;
        }
        CurveIntersections intersects = Intersection.CurveCurve(seg0, seg1, 0.1, 0.1);
        if (intersects == null)
        {
          continue;
        }
        foreach (IntersectionEvent intersect in intersects)
        {
          if (intersect.IsPoint)
          {
            splitParams.Add(intersect.ParameterA);
          }
        }
      }
      Curve[] splitCurves = seg0.Split(splitParams);
      Print(splitCurves.Length.ToString());
      if (splitCurves == null)
      {
        throw new Exception("Splitting curve did not yield correct result.");
      }
      pairwiseSplitCurves.AddRange(splitCurves);
    }
    PairwiseSplitSegments = pairwiseSplitCurves;
# ---------- end pairwisesplitting ----------

crv = Curve(reparameterize(pairwisesplitting.PairwiseSplitSegments))

boundarysampling = CSharpScript(BoundarySegmentCurveList=crv, StepSize=number_slider)  # -> out, SamplePoints; inputs BoundarySegmentCurveList: list of Curve, StepSize: Double
# ---------- boundarysampling: C# ----------
    // Each element is a list of points where the boundary should be sampled.
    List<Point3d> sampleLocations = new List<Point3d>();
    foreach (Curve boundarySegment in BoundarySegmentCurveList)
    {
      double curveLength = boundarySegment.GetLength();
      int regularlySpacedSampleNum = (int)Math.Floor(curveLength / (2 * StepSize));
      boundarySegment.Domain.MakeIncreasing();
      Interval boundaryDomain = boundarySegment.Domain;
      double stepSizeParamSpace = boundaryDomain.Length * (StepSize / curveLength);
      for (int i = 1; i < regularlySpacedSampleNum + 1; i++)
      {
        sampleLocations.Add(boundarySegment.PointAt(boundaryDomain.Min + i * stepSizeParamSpace));
        sampleLocations.Add(boundarySegment.PointAt(boundaryDomain.Max - i * stepSizeParamSpace));
      }
      sampleLocations.Add(boundarySegment.PointAt(boundaryDomain.Mid));
    }
    SamplePoints = sampleLocations;
# ---------- boundarysampling: C# additional code ----------
  DataTree<T> ListOfListsToTree<T>(List<List<T>> list)
  {
    DataTree<T> tree = new DataTree<T>();
    int i = 0;
    foreach (List<T> innerList in list)
    {
      tree.AddRange(innerList, new GH_Path(new int[] { 0, i }));
      i++;
    }
    return tree;
  }
# ---------- end boundarysampling ----------
scriptpar_2 = ScriptParasite(Enable=synchronization_enabled, Folder=script_directory)

boundary_curves = Curve(layout_curves)
duppt = RemoveDuplicatePts(Points=boundarysampling.SamplePoints, Tolerance=0.01)

# ---- group: Create Medial Axis
boundary = BoundarySurfaces(Edges=layout_curves)
voronoi = Voronoi(Points=flatten(duppt), BruteForceOverride=False)

createmedialaxis = CSharpScript(
    voronoiDiagramCurveList=voronoi,
    boundaryCurveList=layout_curves,
    walkableSurfaceBrep=boundary,
    boundaryProximityTolerance=boundary_proximity_tolerance)  # -> out, medialAxisCurveList; inputs voronoiDiagramCurveList: list of Curve, boundaryCurveList: list of Curve, walkableSurfaceBrep: Brep, boundaryProximityTolerance: Double
# ---------- createmedialaxis: C# usings ----------
using System.Linq;
# ---------- createmedialaxis: C# ----------
    // First "explode" all curves from the Voronoi-diagram into segments and eventually save them in array for parallel processing.
    Line[] allSegmentArray = CreateSegmentsSequential(voronoiDiagramCurveList); // For some reason, the sequential method is slightly faster here.

    // Create mask for valid segments.
    bool[] mask = SelectValidSegmentsParallel(allSegmentArray, boundaryCurveList, walkableSurfaceBrep, boundaryProximityTolerance); // Parallel clearly faster.

    // Only select valid medial axis segments.
    List<Line> result = new List<Line>();
    for (int i = 0; i < allSegmentArray.Length; i++)
    {
      if (mask[i])
      {
        result.Add(allSegmentArray[i]);
      }
    }
    medialAxisCurveList = result;
# ---------- createmedialaxis: C# additional code ----------
  private Line[] CreateSegmentsSequential(List<Curve> voronoiDiagramCurveList)
  {
    List<Line> allSegments = new List<Line>();
    foreach (Curve curve in voronoiDiagramCurveList)
    {
      if (curve == null)
      {
        continue;
      }
      if (!curve.IsPolyline())
      {
        throw new Exception("Input curve was not polyline.");
      }
      Polyline polyline = new Polyline();
      curve.TryGetPolyline(out polyline);
      Line[] segments = polyline.GetSegments();
      foreach (Line segment in segments)
      {
        allSegments.Add(segment);
      }
    }
    return allSegments.ToArray();
  }

  private Line[] CreateSegmentsParallel(List<Curve> voronoiDiagramCurveList)
  {
    Line[][] segments = new Line[voronoiDiagramCurveList.Count][];
    System.Threading.Tasks.Parallel.For(0, segments.Length, i =>
      {
      Curve curve = voronoiDiagramCurveList[i];
      if (curve == null)
      {
        throw new Exception("Input curve was null.");
      }
      if (!curve.IsPolyline())
      {
        throw new Exception("Input curve was not polyline.");
      }
      Polyline polyline = new Polyline();
      curve.TryGetPolyline(out polyline);
      segments[i] = polyline.GetSegments();
      });
    return segments.SelectMany(a => a).ToArray();
  }

  /// <summary>
  /// Parallel implementation: Selects all Voronoi-diagram segments that approximate the medial axis.
  /// </summary>
  /// <param name="segments">Segments of the Voronoi-diagram.</param>
  /// <param name="boundaryCurveList">Boundary curves of the shape for which the medial axis is computed.</param>
  /// <param name="walkableSurfaceBrep">Surface inside of the shape.</param>
  /// <param name="boundaryProximityTolerance">If a segment is closer than that to the shape-boundary, it is discarded.</param>
  /// <returns>A boolean array of the same length as <paramref name="segments"/>, acting as a mask for the valid segments.</returns>
  private bool[] SelectValidSegmentsParallel(Line[] segments, List<Curve> boundaryCurveList, Brep walkableSurfaceBrep, double boundaryProximityTolerance)
  {
    bool[] mask = new bool[segments.Length];
    System.Threading.Tasks.Parallel.For(0, mask.Length, i =>
      {
      mask[i] = IsValidSegment(segments[i], boundaryCurveList, walkableSurfaceBrep, boundaryProximityTolerance);
      });
    return mask;
  }

  /// <summary>
  /// Sequential implementation: Selects all Voronoi-diagram segments that approximate the medial axis.
  /// </summary>
  /// <param name="segments">Segments of the Voronoi-diagram.</param>
  /// <param name="boundaryCurveList">Boundary curves of the shape for which the medial axis is computed.</param>
  /// <param name="walkableSurfaceBrep">Surface inside of the shape.</param>
  /// <param name="boundaryProximityTolerance">If a segment is closer than that to the shape-boundary, it is discarded.</param>
  /// <returns>A boolean array of the same length as <paramref name="segments"/>, acting as a mask for the valid segments.</returns>
  private bool[] SelectValidSegmentsSequential(Line[] segments, List<Curve> boundaryCurveList, Brep walkableSurfaceBrep, double boundaryProximityTolerance)
  {
    bool[] mask = new bool[segments.Length];
    for (int i = 0; i < segments.Length; i++)
    {
      mask[i] = IsValidSegment(segments[i], boundaryCurveList, walkableSurfaceBrep, boundaryProximityTolerance);
    }
    return mask;
  }

  /// <summary>
  /// Checks if a segment belongs to the subgraph of the Voronoi-diagram that approximates the medial axis.
  /// </summary>
  /// <param name="segment">The segment for which to check.</param>
  /// <param name="boundaryCurves">The curves describing the boundary for which to find the medial axis.</param>
  /// <returns>true if is medial axis segment, false otherwise.</returns>
  private bool IsValidSegment(Line segment, List<Curve> boundaryCurves, Brep walkableSurfaceBrep, double closenessTolerance)
  {
    bool isIntersecting = SegmentIntersectsBoundary(segment, boundaryCurves, RhinoMath.SqrtEpsilon);
    bool isWalkable = SegmentIsOnWalkableSurface(segment, walkableSurfaceBrep, RhinoMath.SqrtEpsilon);
    bool isTooCloseToBoundary = SegmentIsTooCloseToBoundary(segment, boundaryCurves, closenessTolerance);
    return !isIntersecting && isWalkable && !isTooCloseToBoundary;
  }

  /// <summary>
  /// Checks whether a segment crosses the boundary or is close enough (within a tolerance) to it.
  /// </summary>
  /// <param name="segment">The segment for which to check whether it crosses the boundary.</param>
  /// <param name="boundaryCurves">The curves that define the boundary.</param>
  /// <param name="tolerance">The distance to the boundary must be larger than this to be non-crossing.</param>
  /// <returns>true if the segment crosses the boundary or is too close to it. false otherwise.</returns>
  private bool SegmentIntersectsBoundary(Line segment, List<Curve> boundaryCurves, double tolerance)
  {
    bool intersects = false;
    foreach (Curve boundaryCurve in boundaryCurves)
    {
      if (Rhino.Geometry.Intersect.Intersection.CurveCurve(boundaryCurve, segment.ToNurbsCurve(), tolerance, 0.0).Count != 0)
      {
        intersects = true;
        break;
      }
    }
    return intersects;
  }

  /// <summary>
  /// Checks whether a segment lies on the walkable surface.
  /// </summary>
  /// <param name="segment">The segment for which the property should be checked.</param>
  /// <param name="tolerance">Distance from curve to walkable surface must be smaller than this to count as "on walkable surface".</param>
  /// <param name="walkableSurfaceBrep">The walkable surface.</param>
  /// <returns>true if segment is on walkable surface (within tolerance), false otherwise.</returns>
  private bool SegmentIsOnWalkableSurface(Line segment, Brep walkableSurfaceBrep, double tolerance)
  {
    Curve segmentCurve = segment.ToNurbsCurve();
    Curve[] overlapCurves;
    Point3d[] intersectionPoints;
    Rhino.Geometry.Intersect.Intersection.CurveBrep(segmentCurve, walkableSurfaceBrep, tolerance, out overlapCurves, out intersectionPoints);
    return overlapCurves.Length > 0 || intersectionPoints.Length > 0;
  }

  /// <summary>
  /// Checks for a segment if it is too close to the boundary. It does that by comparing the distance of the endpoints of the segment to all boundary curves.
  /// </summary>
  /// <param name="segment">The segment to check for.</param>
  /// <param name="boundaryCurves">The curves that define the boundary.</param>
  /// <param name="tolerance">If the distance is smaller than this, the segment is considered to be too close.</param>
  /// <returns>true if is too close, false otherwise.</returns>
  private bool SegmentIsTooCloseToBoundary(Line segment, List<Curve> boundaryCurves, double tolerance)
  {
    Curve segmentCurve = segment.ToNurbsCurve();
    Point3d startPoint = segmentCurve.PointAtStart;
    Point3d endPoint = segmentCurve.PointAtEnd;
    for (int i = 0; i < boundaryCurves.Count; i++)
    {
      Curve currCurve = boundaryCurves[i];
      double startParam = 0.1f;
      currCurve.ClosestPoint(startPoint, out startParam);
      if (startPoint.DistanceTo(currCurve.PointAt(startParam)) < tolerance)
      {
        return true;
      }
      double endParam = 0.1f;
      currCurve.ClosestPoint(endPoint, out endParam);
      if (endPoint.DistanceTo(currCurve.PointAt(endParam)) < tolerance)
      {
        return true;
      }
    }
    return false;
  }
# ---------- end createmedialaxis ----------
scriptpar_3 = ScriptParasite(Enable=synchronization_enabled, Folder=script_directory)

# ----
crv_2 = Curve(crv)
dupln = RemoveDuplicateLines(Lines=createmedialaxis.medialAxisCurveList, Tolerance=Slider(0.0001, range=0..1))
end = EndPoints(Curve=crv_2)  # -> Start, End
disc = Discontinuity(Curve=boundary_curves, Level=1)  # -> flatten(Points), Parameters
join = JoinCurves(Curves=createmedialaxis.medialAxisCurveList, Preserve=False)

# ---- group: Recover Ordering of Individual Segments
explode_2 = Explode(Curve=join, Recursive=True)  # -> flatten(Segments), Vertices

# ----
item = ListItem(List=explode_2.Segments, Index=Slider(5100, range=5000..5100), Wrap=True)
pt = Point([disc.Points, end.Start, end.End])
item_2 = ListItem(List=explode_2.Segments, Index=Slider(1300, range=0..1300), Wrap=True)

branchpointclassificitaion = CSharpScript(
    SegmentCurveList=explode_2.Segments,
    LowerTolerance=Slider(40, range=0..1000),
    UpperTolerance=Slider(160, range=0..500),
    idx=Slider(0, range=0..350))  # -> out, BranchPointList, BranchPointDelimitedCurveList, SelectedCurves, SelectedAngles; inputs SegmentCurveList: list of Curve, LowerTolerance: Double, UpperTolerance: Double, idx: Int32
# ---------- branchpointclassificitaion: C# usings ----------
using System.Diagnostics;
using Rhino.Geometry.Intersect;
# ---------- branchpointclassificitaion: C# ----------
    List<List<Curve>> contiguousSegmentList = PartitionSegmentsByAdjacencyParallel(SegmentCurveList); // Empirically, parallel method was substantially faster.

    // Split the first segment in each list of contiguous segment, to avoid that second segment is directly after branchpoint, which would not be detected in this case.
    /*
    foreach (List<Curve> contiguousSegments in contiguousSegmentList)
    {
      Curve firstSeg = contiguousSegments[0];
      Curve[] splitFirstSeg = firstSeg.Split(firstSeg.Domain.Mid);
      if (splitFirstSeg == null)
      {
        throw new Exception("Splitting first segment yielded null");
      }

      // Insert split segments back into list. Notice the order.
      contiguousSegments.Insert(0, splitFirstSeg[1]);
      contiguousSegments.Insert(0, splitFirstSeg[0]);

      Curve lastSeg = contiguousSegments[contiguousSegments.Count - 1];
      Curve[] splitLastSeg = lastSeg.Split(lastSeg.Domain.Mid);
      if (splitLastSeg == null)
      {
        throw new Exception("Splitting first segment yielded null");
      }

      // Insert split segments back into list. Notice the order.
      contiguousSegments.Insert(contiguousSegments.Count - 1, splitLastSeg[0]);
      contiguousSegments.Insert(contiguousSegments.Count - 1, splitLastSeg[1]);
    }
    */
    SelectedCurves = contiguousSegmentList[idx];
    SelectedAngles = CalculateAngles(contiguousSegmentList[idx]);

    // Find branchpoints first, then split segments.
    List<Point3d> branchPoints = new List<Point3d>();
    foreach (List<Curve> contiguousSegments in contiguousSegmentList)
    {
      double[] angles = CalculateAngles(contiguousSegments);
      for (int i = 0; i < angles.Length; i++)
      {
        double currAngle = angles[i];
        bool branchPointDetected = ContainsPointParallel(contiguousSegments[i].PointAtEnd, branchPoints, RhinoMath.SqrtEpsilon);
        if (LowerTolerance <= currAngle && currAngle <= UpperTolerance || branchPointDetected)
        {
          if (!branchPointDetected)
          {
            branchPoints.Add(contiguousSegments[i].PointAtEnd);
          }
        }
      }
    }

    Print("Number of branchpoints: " + branchPoints.Count);

    // Find branchpoints for each list of contiguous segments.
    List<Curve> branchPointDelimitedSegments = new List<Curve>();
    foreach (List<Curve> contiguousSegments in contiguousSegmentList)
    {
      List<Curve> currSegs = new List<Curve>();
      for (int i = 0; i < contiguousSegments.Count; i++)
      {
        currSegs.Add(contiguousSegments[i]);
        bool branchPointDetected = ContainsPointParallel(contiguousSegments[i].PointAtEnd, branchPoints, RhinoMath.SqrtEpsilon);
        if (branchPointDetected)
        {
          Curve[] joinedCurves = Curve.JoinCurves(currSegs, RhinoMath.SqrtEpsilon);
          if (joinedCurves.Length == 0)
          {
            throw new Exception("Joining curves was not successful.");
          }
          branchPointDelimitedSegments.AddRange(joinedCurves);
          currSegs = new List<Curve>();
        }
      }

      // Join the remaining unjoined segments.
      Curve[] lastJoinedCurves = Curve.JoinCurves(currSegs);
      if (lastJoinedCurves.Length == 0)
      {
        throw new Exception("Joining curves at end was not successful.");
      }

      branchPointDelimitedSegments.AddRange(lastJoinedCurves);
    }
    BranchPointDelimitedCurveList = branchPointDelimitedSegments;
    BranchPointList = branchPoints;
# ---------- branchpointclassificitaion: C# additional code ----------
  private List<List<Curve>> PartitionSegmentsByAdjacencySequential(List<Curve> segmentCurveList)
  {
    // The medial axis comes in form of many line segments, which are not necessarily all consecutive. First, partition consecutive segments into sublists.
    List<List<Curve>> contiguousSegments = new List<List<Curve>>();
    List<Curve> contiguousSegment = new List<Curve>();
    for (int i = 0; i < segmentCurveList.Count - 1; i++)
    {
      // Always add the current segment.
      Curve currSeg = segmentCurveList[i];
      contiguousSegment.Add(currSeg);

      // Check for an intersect (then the segments are contiguous).
      Curve nextSeg = segmentCurveList[i + 1];
      CurveIntersections intersects = Intersection.CurveCurve(currSeg, nextSeg, RhinoMath.SqrtEpsilon, RhinoMath.SqrtEpsilon);
      if (intersects == null)
      {
        continue;
      }

      // No intersection, therefore the segments are not contiguous.
      if (intersects.Count == 0)
      {
        contiguousSegments.Add(contiguousSegment);
        contiguousSegment = new List<Curve>();
      }
    }
    contiguousSegment.Add(segmentCurveList[segmentCurveList.Count - 1]);
    contiguousSegments.Add(contiguousSegment);
    return contiguousSegments;
  }

  private List<List<Curve>> PartitionSegmentsByAdjacencyParallel(List<Curve> segmentCurveList)
  {
    // Duplicate lists to avoid read/write conflicts.
    List<Curve> duplicateSegmentCurveList = new List<Curve>(segmentCurveList); // The copying might be more costly than the sequential check.
    bool[] notAdjacent = new bool[segmentCurveList.Count - 1]; // Entry is true whenever the consecutive segment is not adjacent.
    System.Threading.Tasks.Parallel.For(0, notAdjacent.Length, i =>
      {
      CurveIntersections intersects = Intersection.CurveCurve(segmentCurveList[i], duplicateSegmentCurveList[i + 1], RhinoMath.SqrtEpsilon, RhinoMath.SqrtEpsilon);
      if (intersects != null)
      {
        if (intersects.Count == 0)
        {
          notAdjacent[i] = true;
        }
      }
      });

    List<List<Curve>> contiguousSegmentLists = new List<List<Curve>>();
    contiguousSegmentLists = new List<List<Curve>>();
    List<Curve> contiguousSegments = new List<Curve>();
    for (int i = 0; i < notAdjacent.Length; i++)
    {
      contiguousSegments.Add(segmentCurveList[i]);
      if (notAdjacent[i])
      {
        contiguousSegmentLists.Add(contiguousSegments);
        contiguousSegments = new List<Curve>();
      }
    }
    contiguousSegments.Add(segmentCurveList[segmentCurveList.Count - 1]);
    contiguousSegmentLists.Add(contiguousSegments);
    return contiguousSegmentLists;
  }

  private double[] CalculateAngles(List<Curve> segments)
  {
    Vector3d[] vectors = new Vector3d[segments.Count];
    for (int i = 0; i < segments.Count; i++)
    {
      Curve currSeg = segments[i];
      vectors[i] = new Vector3d(currSeg.PointAtEnd - currSeg.PointAtStart);
    }
    double[] angles = new double[segments.Count - 1];
    for (int i = 0; i < segments.Count - 1; i++)
    {
      angles[i] = RhinoMath.ToDegrees(Vector3d.VectorAngle(vectors[i], vectors[i + 1]));
    }
    return angles;
  }

  private double[] FiniteDifferences(double[] values)
  {
    double[] diffs = new double[values.Length - 1];
    for (int i = 0; i < diffs.Length; i++)
    {
      diffs[i] = values[i + 1] - values[i];
    }
    return diffs;
  }

  private bool ContainsPointParallel(Point3d queryPoint, List<Point3d> pointList, double tol)
  {
    bool[] isClose = new bool[pointList.Count];
    System.Threading.Tasks.Parallel.For(0, pointList.Count, i =>
    {
      isClose[i] = queryPoint.DistanceTo(pointList[i]) < tol;
    });
    for (int i = 0; i < isClose.Length; i++)
    {
      if (isClose[i])
      {
        return true;
      }
    }
    return false;
  }
# ---------- end branchpointclassificitaion ----------
scriptpar_4 = ScriptParasite(Enable=synchronization_enabled, Folder=script_directory)

cornersformedialaxisclassification = CSharpScript(UnprocessedCornerPointList=pt, BoundaryCurveList=crv_2)  # -> out, ProcessedCornerPointList; inputs UnprocessedCornerPointList: list of Point3d, BoundaryCurveList: list of Curve
# ---------- cornersformedialaxisclassification: C# ----------
    List<Point3d> processedCornerList = new List<Point3d>();
    foreach (Point3d corner in UnprocessedCornerPointList)
    {
      int adjacent = 0;
      foreach (Curve boundary in BoundaryCurveList)
      {
        double closestParam;
        boundary.ClosestPoint(corner, out closestParam);
        bool isClose = corner.DistanceTo(boundary.PointAt(closestParam)) < 0.1;
        if (isClose)
        {
          adjacent++;
        }
        if (adjacent > 2)
        {
          break;
        }
      }
      if (adjacent <= 2)
      {
        processedCornerList.Add(corner);
      }
    }
    ProcessedCornerPointList = processedCornerList;
# ---------- end cornersformedialaxisclassification ----------
scriptpar_5 = ScriptParasite(Enable=synchronization_enabled, Folder=script_directory)

number_slider_2 = Slider(49, range=0..230)

filterrealcorners = CSharpScript(CornerPointList=pt)  # -> out, RealCorners; inputs CornerPointList: list of Point3d, BoundaryCurveList: list of Curve
# ---------- filterrealcorners: C# ----------
    // Check for each corner point if it is adjacent to a line, but not to its endpoints.
    // That makes it not a real corner.
    List<Point3d> realCorners = new List<Point3d>();
    foreach (Point3d corner in CornerPointList)
    {
      bool isRealCorner = true;
      foreach (Curve boundary in BoundaryCurveList)
      {
        double param;
        boundary.ClosestPoint(corner, out param);
        Point3d onLine = boundary.PointAt(param);

        // The point does not even lie on the line.
        if (corner.DistanceTo(onLine) > RhinoMath.DefaultDistanceToleranceMillimeters)
        {
          continue;
        }

        // Now check if it is one of the endpoints.
        bool isStartPoint = corner.DistanceTo(boundary.PointAtStart) < RhinoMath.DefaultDistanceToleranceMillimeters;
        bool isEndPoint = corner.DistanceTo(boundary.PointAtEnd) < RhinoMath.DefaultDistanceToleranceMillimeters;
        if (!isStartPoint && !isEndPoint)
        {
          isRealCorner = false;
          break;
        }
      }
      if (isRealCorner)
      {
        realCorners.Add(corner);
      }
    }
    RealCorners = realCorners;
# ---------- end filterrealcorners ----------
scriptpar_6 = ScriptParasite(Enable=toggle, Folder=panel)

crv_3 = Curve(reparameterize(branchpointclassificitaion.BranchPointDelimitedCurveList))
item_3 = ListItem(List=branchpointclassificitaion.SelectedAngles, Index=number_slider_2, Wrap=True)
crv_4 = Curve(reparameterize(branchpointclassificitaion.BranchPointDelimitedCurveList))
item_4 = ListItem(List=crv_4, Index=number_slider_2, Wrap=True)
duppt_2 = RemoveDuplicatePts(Points=filterrealcorners.RealCorners, Tolerance=0.01)
explode_3 = Explode(Curve=layout_curves, Recursive=True)  # -> flatten(Segments), Vertices
duppt_3 = RemoveDuplicatePts(Points=branchpointclassificitaion.BranchPointList, Tolerance=0.01)
pt_2 = Point(cornersformedialaxisclassification.ProcessedCornerPointList)
panel_2 = Panel(item_3)

filtercoveredsegments = CSharpScript(SegmentCurveList=branchpointclassificitaion.BranchPointDelimitedCurveList)  # -> out, UncoveredSegmentCurves; inputs SegmentCurveList: list of Curve
# ---------- filtercoveredsegments: C# ----------
    // Sort segments by length.
    // Lustig lustig trallalala
    double[] lengths = new double[SegmentCurveList.Count];
    System.Threading.Tasks.Parallel.For(0, SegmentCurveList.Count, i =>
    {
      lengths[i] = SegmentCurveList[i].GetLength();
    });
    Curve[] segmentCurveArray = SegmentCurveList.ToArray();
    Array.Sort(lengths, segmentCurveArray);
    Array.Reverse(segmentCurveArray);

    // Create mask indicating if segment is covered.
    bool[] covered = new bool[segmentCurveArray.Length];

    // Test for each pair if the segment of greater or equal length completely covers the smaller segment.
    for (int i = 0; i < segmentCurveArray.Length; i++)
    {
      if (covered[i])
      {
        continue;
      }
      Curve largeSeg = segmentCurveArray[i];
      for (int j = i + 1; j < segmentCurveArray.Length; j++)
      {
        if (covered[j])
        {
          continue;
        }

        Curve smallSeg = segmentCurveArray[j];
        // Check if the smaller curve is covered completely by the larger curve, i.e.:
        // 1. There is an intersection.
        // 2. This intersection is an overlap.
        // 3. Up to some tolerance, the overlap domain is equivalent to the domain of the smaller curve.
        CurveIntersections intersects = Intersection.CurveCurve(largeSeg, smallSeg, RhinoMath.SqrtEpsilon, RhinoMath.SqrtEpsilon);
        if (intersects == null)
        {
          // No intersections.
          continue;
        }
        foreach (IntersectionEvent intersect in intersects)
        {
          if (!intersect.IsOverlap)
          {
            continue;
          }
          Interval smallDomain = smallSeg.Domain;
          if (intersect.OverlapB.Min <= smallDomain.Min + RhinoMath.SqrtEpsilon && smallDomain.Max - RhinoMath.SqrtEpsilon <= intersect.OverlapB.Max)
          {
            covered[j] = true;
          }
        }
      }
    }

    // Filter curves that are covered.
    List<Curve> notCovered = new List<Curve>();
    for (int i = 0; i < segmentCurveArray.Length; i++)
    {
      if (!covered[i])
      {
        notCovered.Add(segmentCurveArray[i]);
      }
    }
    UncoveredSegmentCurves = notCovered;
# ---------- end filtercoveredsegments ----------
scriptpar_7 = ScriptParasite(Enable=synchronization_enabled, Folder=script_directory)

number_slider_3 = Slider(0, range=0..100)
multiplication = Multiplication(A=Slider(2.5, range=0..10), B=boundary_proximity_tolerance)
cir = Circle(Plane=filterrealcorners.RealCorners, Radius=multiplication)
item_5 = ListItem(List=filtercoveredsegments.UncoveredSegmentCurves, Index=Slider(153, range=0..162), Wrap=True)

filterinvalidsegments = CSharpScript(
    SegmentCurveList=filtercoveredsegments.UncoveredSegmentCurves,
    MinLength=Slider(0.1, range=0..5),
    BranchPointList=duppt_3)  # -> out, FilteredSegmentCurveList; inputs SegmentCurveList: list of Curve, MinLength: Double, BranchPointList: list of Point3d
# ---------- filterinvalidsegments: C# ----------
    List<Curve> filteredSegments = new List<Curve>();
    foreach (Curve segment in SegmentCurveList)
    {
      if (segment.GetLength() >= MinLength || ContainsPointParallel(segment.PointAtStart, BranchPointList, RhinoMath.SqrtEpsilon) || ContainsPointParallel(segment.PointAtEnd, BranchPointList, RhinoMath.SqrtEpsilon))
      {
        filteredSegments.Add(segment);
      }
    }
    FilteredSegmentCurveList = filteredSegments;
# ---------- filterinvalidsegments: C# additional code ----------
  private bool ContainsPointParallel(Point3d queryPoint, List<Point3d> pointList, double tol)
  {
    bool[] isClose = new bool[pointList.Count];
    System.Threading.Tasks.Parallel.For(0, pointList.Count, i =>
    {
      isClose[i] = queryPoint.DistanceTo(pointList[i]) < tol;
    });
    for (int i = 0; i < isClose.Length; i++)
    {
      if (isClose[i])
      {
        return true;
      }
    }
    return false;
  }
# ---------- end filterinvalidsegments ----------
scriptpar_8 = ScriptParasite(Enable=synchronization_enabled, Folder=script_directory)

item_6 = ListItem(List=filterinvalidsegments.FilteredSegmentCurveList, Index=Slider(48, range=0..186), Wrap=True)
crv_5 = Curve(reparameterize(filterinvalidsegments.FilteredSegmentCurveList))
number_slider_4 = Slider(0, range=0..1)

topologizer = CSharpScript(
    SegmentCurveList=crv_5,
    BranchPointList=duppt_3,
    CornerPointList=duppt_2,
    CornerTol=boundary_proximity_tolerance,
    pairIdx=Slider(0, range=0..100))  # -> out, BranchPointDelimitedCurvesList, SplitSegments, crv1, crv2, specialIntersects, A, B, step1Segs, pair; inputs SegmentCurveList: list of Curve, BranchPointList: list of Point3d, CornerPointList: list of Point3d, CornerTol: Double, idx1: Int32, idx2: Int32, pairIdx: Int32
# ---------- topologizer: C# ----------
    List<Curve> splitSegments = SplitAtCorners(SegmentCurveList, CornerPointList, BranchPointList, CornerTol);
    step1Segs = new List<Curve>(splitSegments);
    List<List<Curve>> intersectionPairs = new List<List<Curve>>();
    for (int i = 0; i < splitSegments.Count; i++)
    {
      Curve seg0 = splitSegments[i];
      for (int j = i + 1; j < splitSegments.Count; j++)
      {
        Curve seg1 = splitSegments[j];

        // Intersection test.
        CurveIntersections intersects = Intersection.CurveCurve(seg0, seg1, 0.1, 0.1);

        // No intersections.
        if (intersects == null)
        {
          continue;
        }

        // Check for overlaps.
        foreach (IntersectionEvent intersect in intersects)
        {
          if (intersect.IsPoint)
          {
            intersectionPairs.Add(new List<Curve> { seg0, seg1 });
            if (!IsCurveEndPoint(seg0, intersect.ParameterA, RhinoMath.SqrtEpsilon))
            {
              Curve[] split0 = seg0.Split(intersect.ParameterA);
              if (split0 == null)
              {
                throw new Exception("Splitting at point intersection with first segment failed.");
              }
              Curve longerSeg0 = split0[0].GetLength() > split0[1].GetLength() ? split0[0] : split0[1];
              splitSegments.AddRange(split0);
              seg0 = longerSeg0;
            }
            if (!IsCurveEndPoint(seg1, intersect.ParameterB, RhinoMath.SqrtEpsilon))
            {
              Curve[] split1 = seg1.Split(intersect.ParameterB);
              Curve longerSeg1 = split1[0].GetLength() > split1[1].GetLength() ? split1[0] : split1[1];
              splitSegments[j] = longerSeg1;
              seg1 = longerSeg1;
            }
            continue;
          }
          else // Intersection is overlap.
          {
            // Check if the first segment is completely covered by the second one.
            if (intersect.OverlapA.Min <= seg0.Domain.Min + RhinoMath.SqrtEpsilon && seg0.Domain.Max - RhinoMath.SqrtEpsilon <= intersect.OverlapA.Max)
            {
              splitSegments[i] = null;
            }
            else
            {
              // Otherwise just remove the part from the first segment that is overlapping.
              bool minInDomain = IsInCurveDomain(seg0, intersect.OverlapA.Min, RhinoMath.SqrtEpsilon);
              bool maxInDomain = IsInCurveDomain(seg0, intersect.OverlapA.Max, RhinoMath.SqrtEpsilon);

              // Ensure that always exactly one side of the interval is in the domain, otherwise this would not be a valid overlap.
              if (!minInDomain ^ maxInDomain)
              {
                if (intersect.OverlapA.Max - intersect.OverlapA.Min < RhinoMath.SqrtEpsilon || intersect.OverlapB.Max - intersect.OverlapB.Min < RhinoMath.SqrtEpsilon)
                {
                  // This should actually be a point-intersection, but for some reason, Rhino fucked up.
                  if (!IsCurveEndPoint(seg0, intersect.ParameterA, RhinoMath.SqrtEpsilon))
                  {
                    // Curves intersect at endpoints, so we can ignore that case.
                    Curve[] split0 = seg0.Split(intersect.ParameterA);
                    Curve longerSeg0 = split0[0].GetLength() > split0[1].GetLength() ? split0[0] : split0[1];
                    splitSegments[i] = longerSeg0;
                  }
                  if (!IsCurveEndPoint(seg1, intersect.ParameterB, RhinoMath.SqrtEpsilon))
                  {
                    Curve[] split1 = seg1.Split(intersect.ParameterB);
                    Curve longerSeg1 = split1[0].GetLength() > split1[1].GetLength() ? split1[0] : split1[1];
                    splitSegments[j] = longerSeg1;
                  }
                  continue;
                }
                continue;
              }
              Curve segmentToSurvive;
              if (minInDomain)
              {
                segmentToSurvive = seg0.Split(intersect.OverlapA.Min)[0];
              }
              else
              {
                segmentToSurvive = seg0.Split(intersect.OverlapA.Max)[1];
              }
              splitSegments[i] = segmentToSurvive;
              seg0 = segmentToSurvive;
            }
          }
        }
      }
    }
    pair = intersectionPairs[pairIdx]; 
    SplitSegments = splitSegments;

    // Building segment graph where segments are nodes and there is and edge between segments iff they intersect at a point which is not a branchpoint.
    Dictionary<Curve, List<Curve>> segmentGraph = new Dictionary<Curve, List<Curve>>();
    for (int i = 0; i < splitSegments.Count; i++)
    {
      Curve seg0 = splitSegments[i];
      if (seg0 == null)
      {
        continue;
      }
      segmentGraph[seg0] = new List<Curve> { seg0 };
      for (int j = 0; j < splitSegments.Count; j++)
      {
        if (i == j)
        {
          continue;
        }
        Curve seg1 = splitSegments[j];
        if (seg1 == null)
        {
          continue;
        }
        CurveIntersections intersects = Intersection.CurveCurve(seg0, seg1, 0.1, 0.1);

        // No intersections between curves.
        if (intersects == null)
        {
          continue;
        }

        // Go through each intersect and check whether curves intersect at point which is not branchpoint. In that case, we create an edge.
        foreach (IntersectionEvent intersect in intersects)
        {
          Point3d intersectionPoint = intersect.PointA;
          if (!ContainsPointParallel(intersectionPoint, BranchPointList, 0.1))
          {
            segmentGraph[seg0].Add(seg1);
          }
        }
      }
    }

    // Run BFS for each start node to find connected component.
    List<Curve> joinedSegments = new List<Curve>();
    Dictionary<Curve, bool> visited = new Dictionary<Curve, bool>(); // Tracks whether a curve was already assigned to a connected component.
    foreach (KeyValuePair<Curve, List<Curve>> keyVal in segmentGraph)
    {

      visited[keyVal.Key] = false;
    }
    foreach (KeyValuePair<Curve, List<Curve>> keyValue in segmentGraph)
    {
      Curve initSeg = keyValue.Key;
      List<Curve> neighbors = keyValue.Value;
      if (visited[initSeg])
      {
        continue;
      }

      if (neighbors.Count == 1)
      {
        joinedSegments.Add(initSeg); // If there is only one neighbor, then it is the curve itself and we can join it without any additional joining.
        continue;
      }

      // The segment has more than one neighbor, so we run BFS to find connected component.
      List<Curve> connectedComponent = new List<Curve>();
      Queue<Curve> queue = new Queue<Curve>();
      queue.Enqueue(initSeg);
      while (queue.Count != 0)
      {
        Curve currSeg = queue.Dequeue();
        if (visited[currSeg])
        {
          continue;
        }
        connectedComponent.Add(currSeg);
        visited[currSeg] = true;
        foreach (Curve neighbor in segmentGraph[currSeg])
        {
          queue.Enqueue(neighbor);
        }
      }
      Curve[] joinedConnectedComponent = Curve.JoinCurves(connectedComponent, 1.0);
      if (joinedConnectedComponent.Length > 1)
      {
        CurveIntersections intersects = Intersection.CurveCurve(joinedConnectedComponent[0], joinedConnectedComponent[1], RhinoMath.SqrtEpsilon, RhinoMath.SqrtEpsilon);
      }
      joinedSegments.Add(joinedConnectedComponent[0]);
    }
    BranchPointDelimitedCurvesList = joinedSegments;
# ---------- topologizer: C# additional code ----------
  private bool IsCurveEndPoint(Curve curve, double param, double tol)
  {
    Interval curveDomain = curve.Domain;
    return param <= curve.Domain.Min + tol || curveDomain.Max - tol <= param;
  }

  private bool IsInCurveDomain(Curve curve, double param, double tol)
  {
    Interval curveDomain = curve.Domain;
    return curveDomain.Min + tol <= param && param <= curveDomain.Max - tol;
  }
  private bool ContainsPointParallel(Point3d queryPoint, List<Point3d> pointList, double tol)
  {
    bool[] isClose = new bool[pointList.Count];
    System.Threading.Tasks.Parallel.For(0, pointList.Count, i =>
    {
      isClose[i] = queryPoint.DistanceTo(pointList[i]) < tol;
    });
    for (int i = 0; i < isClose.Length; i++)
    {
      if (isClose[i])
      {
        return true;
      }
    }
    return false;
  }

  private List<Curve> SplitAtCorners(List<Curve> segments, List<Point3d> corners, List<Point3d> branchpoints, double cornerTol)
  {
    List<Curve> splitSegments = new List<Curve>();
    foreach (Curve seg in segments)
    {
      bool wasSplit = false;
      foreach (Point3d corner in corners)
      {
        double closestCornerParam;
        seg.ClosestPoint(corner, out closestCornerParam);
        Interval domain = seg.Domain;
        if (corner.DistanceTo(seg.PointAt(closestCornerParam)) > 2.5 * cornerTol)
        {
          continue;
        }
        // At this point we assume that only a segment that reaches into a corner can come closes enough to fulfill this condition.
        // There are two cases:
        // 1. Either the closest point to a corner lies somewhere within the segment, in which case we simply split it and choose the longer split segment and discard the other.
        // 2. The closest point is a start or end point of the segment. In this case we need to find the closest branchpoint and split the segment there, again discarding the shorter one.
        if (IsCurveEndPoint(seg, closestCornerParam, RhinoMath.SqrtEpsilon))
        {
          foreach (Point3d branchpoint in branchpoints)
          {
            double closestBranchpointParam;
            seg.ClosestPoint(branchpoint, out closestBranchpointParam);
            if (seg.PointAt(closestBranchpointParam).DistanceTo(branchpoint) < RhinoMath.SqrtEpsilon)
            {
              if (IsCurveEndPoint(seg, closestBranchpointParam, RhinoMath.SqrtEpsilon))
              {
                // In this case the segment is already well-formed, as the brachpoint lies on the other end of the segment.
                break;
              }

              Curve[] splitAtBranchPoint = seg.Split(closestBranchpointParam);

              // Null check.
              if (splitAtBranchPoint == null)
              {
                throw new Exception("Attempted to split corner-segment at branchpoint: " + closestCornerParam.ToString() + ", " + closestBranchpointParam.ToString());
              }

              // Identify longer segment.
              Curve longerSplit = splitAtBranchPoint[0].GetLength() > splitAtBranchPoint[1].GetLength() ? splitAtBranchPoint[0] : splitAtBranchPoint[1];
              splitSegments.Add(longerSplit);
              wasSplit = true;
              break;
            }
          }
        }
        else
        {
          Curve[] splitAtCorner = seg.Split(closestCornerParam);
          if (splitAtCorner == null)
          {
            throw new Exception("Attempted to split corner-segment at corner.");
          }
          Curve longerSplit = splitAtCorner[0].GetLength() > splitAtCorner[1].GetLength() ? splitAtCorner[0] : splitAtCorner[1];
          splitSegments.Add(longerSplit);
          wasSplit = true;
        }
        break;
      }
      if (!wasSplit)
      {
        splitSegments.Add(seg);
      }
    }
    return splitSegments;
  }
# ---------- end topologizer ----------
scriptpar_9 = ScriptParasite(Enable=synchronization_enabled, Folder=script_directory)

python = GhPythonScript(inputs=topologizer.BranchPointDelimitedCurvesList)  # -> out, a; inputs inputs: list
# ---------- python: Python ----------
__author__ = "rapha"
__version__ = "2022.02.11"

import rhinoscriptsyntax as rs

if len(inputs) <= 1:
    a = [0.5]
else:
    a = [1.0 / (len(inputs) - 1) * i for i in range(len(inputs))]
# ---------- end python ----------
gradient = Gradient(
    LowerLimit=0,
    UpperLimit=1,
    Parameter=python.a,
    stops=[0: RGB(243, 57, 0), 0.1: RGB(236, 27, 60), 0.2: RGB(210, 0, 118), 0.3: RGB(103, 0, 120), 0.4: RGB(39, 72, 161), 0.5: RGB(1, 192, 229), 0.6: RGB(18, 178, 90), 0.7: RGB(79, 186, 8), 0.8: RGB(220, 237, 32), 0.9: RGB(247, 159, 20), 1: RGB(243, 57, 0)])
number_slider_5 = Slider(0, range=0..100)
number_slider_6 = Slider(1, range=0..1)
crv_6 = Curve(reparameterize(topologizer.step1Segs))
crv_7 = Curve(topologizer.crv1)
previewlw_2 = CustomPreviewLineweights(Geometry=topologizer.BranchPointDelimitedCurvesList, Shader=gradient, Thickness=Slider(20, range=0..50), Absolute=False)
crv_8 = Curve(topologizer.BranchPointDelimitedCurvesList)
number_slider_7 = Slider(39, range=0..100)
len_2 = Length(Curve=crv_7)
crv_9 = Curve(topologizer.BranchPointDelimitedCurvesList)
item_7 = ListItem(List=crv_6, Index=Slider(54, range=0..137), Wrap=True)
crv_10 = Curve(topologizer.SplitSegments)
filterinvalidsegments_2 = CSharpScript(SegmentCurveList=topologizer.BranchPointDelimitedCurvesList, MinLength=Slider(1, range=0..1), BranchPointList=duppt_3)  # -> out, FilteredSegmentCurveList; inputs SegmentCurveList: list of Curve, MinLength: Double, BranchPointList: list of Point3d; same code as filterinvalidsegments
crv_11 = Curve(topologizer.pair)
item_8 = ListItem(List=crv_9, Index=Slider(56, range=0..81), Wrap=True)
eval_2 = EvaluateCurve(Curve=item_7, Parameter=Slider(1, range=0..1))  # -> Point, Tangent, Angle
item_9 = ListItem(List=crv_11, Index=Slider(1, range=0..1), Wrap=True)
crv_12 = Curve(reparameterize(filterinvalidsegments_2.FilteredSegmentCurveList))

classifymedialaxissegments = CSharpScript(
    MedialAxisCurveList=crv_12,
    InitialStepSize=Slider(4, range=0..10),
    BoundaryCurveList=explode_3.Segments,
    CornerPointList=pt_2,
    BranchPointList=duppt_3)  # -> out, ClassifiedPointList, TypeList, initialEvaluationPointsOut, SwitchPointLocations, SwitchPointTypes, Chords, BranchPointBoundaries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; inputs MedialAxisCurveList: list of Curve, InitialStepSize: Double, BoundaryCurveList: list of Curve, CornerPointList: list of Point3d, BranchPointList: list of Point3d, idx: Int32, t: Double
# ---------- classifymedialaxissegments: C# usings ----------
using Rhino.Geometry.Intersect;
using System.Linq;
# ---------- classifymedialaxissegments: C# ----------
    Curve selectedCurve = MedialAxisCurveList[idx];
    qPoint = selectedCurve.PointAt(t);
    Chord testChord = GetChordParallel(selectedCurve.PointAt(t), BoundaryCurveList);
    chord1 = testChord.points.Item1;
    chord2 = testChord.points.Item2;
    crv1 = testChord.curves.Item1;
    crv2 = testChord.curves.Item2;
    radius1 = selectedCurve.PointAt(t).DistanceTo(testChord.points.Item1);
    radius2 = selectedCurve.PointAt(t).DistanceTo(testChord.points.Item2);

    // Parameters corresponding to the locations of the points to be classified.
    List<double> queryParams = new List<double>();

    // Locations of the points to be classified.
    List<Point3d> queryPoints = new List<Point3d>();

    // Maps medial axis segments to sublist (indexes by start and length) containing the classified medial axis points.
    Dictionary<Curve, Tuple<int, int>> medialAxisCurve2Index = new Dictionary<Curve, Tuple<int, int>>();
    foreach (Curve medialAxisCurve in MedialAxisCurveList)
    {
      List<double> parameters = new List<double>();
      if (medialAxisCurve.GetLength() < InitialStepSize)
      {
        parameters.Add(medialAxisCurve.Domain.Mid);
      }
      else
      {
        parameters.AddRange(medialAxisCurve.DivideByLength(InitialStepSize, includeEnds: false));
      }
      Tuple<int, int> tup = new Tuple<int, int>(queryPoints.Count, parameters.Count);
      medialAxisCurve2Index.Add(medialAxisCurve, tup);
      foreach (double param in parameters)
      {
        queryPoints.Add(medialAxisCurve.PointAt(param));
      }
      queryParams.AddRange(parameters);
    }
    int[] types = new int[queryPoints.Count];
    System.Threading.Tasks.Parallel.For(0, queryPoints.Count, i =>
    {
      types[i] = ClassifyMedialAxisPoint(queryPoints[i], CornerPointList, BoundaryCurveList);
    });

    List<int> typeList = types.ToList();

    // Now we identify all switchpoints. A switchpoint is given as a three-tuple:
    // 1. Parameter of the switchpoint on the curve.
    // 2. Type of the previous segment.
    // 3. Type of the following segment
    Dictionary<Curve, List<SwitchPoint>> medialAxisCurve2SwitchPointList = new Dictionary<Curve, List<SwitchPoint>>();
    foreach (Curve medialAxisCurve in MedialAxisCurveList)
    {

      // Initialize.
      medialAxisCurve2SwitchPointList[medialAxisCurve] = new List<SwitchPoint>();

      // Get sublist of classified points parameters and types.
      Tuple<int, int> range = medialAxisCurve2Index[medialAxisCurve];
      List<double> currParams = queryParams.GetRange(range.Item1, range.Item2);
      List<int> currTypes = typeList.GetRange(range.Item1, range.Item2);

      // Find first point that is not classified as full-ligature. Everything before that point will be assumend to be a full-ligature.
      int startIdx = 0;
      while (startIdx < currTypes.Count && currTypes[startIdx] == 2)
      {
        startIdx++;
      }

      if (startIdx == currTypes.Count)
      {
        // This segment only consists of full ligatures, so we can set the startIdx back to 0.
        startIdx = 0;
      }

      double lastFullLigParam = startIdx > 1 ? currParams[startIdx - 1] : 0.0;

      // Find first switch-point. Work from inside to outside.
      double startSwitchParam = 0.0;
      if (startIdx == 0)
      {
        Chord initChord = GetChordParallel(medialAxisCurve.PointAt(currParams[startIdx]), BoundaryCurveList);
        startSwitchParam = FindStartSwitchPoint(medialAxisCurve, CornerPointList, BoundaryCurveList, lastFullLigParam, currParams[startIdx], currTypes[startIdx], initChord);
      }
      else
      {
        startSwitchParam = FindSwitchPoint(medialAxisCurve, CornerPointList, BoundaryCurveList, lastFullLigParam, currParams[startIdx], 2);
      }
      medialAxisCurve2SwitchPointList[medialAxisCurve].Add(new SwitchPoint(startSwitchParam, 2, currTypes[startIdx]));

      // Now we will construct all switch points:
      int currType = currTypes[startIdx];
      double lastParam = currParams[startIdx];
      int endIdx = currTypes.Count - 1;
      while (endIdx >= 0 && currTypes[endIdx] == 2)
      {
        endIdx--;
      }

      if (endIdx == -1)
      {
        // We went all the way to the beginning. We can set the index to the last element.
        endIdx = currTypes.Count - 1;
      }
      for (int i = startIdx + 1; i < endIdx + 1; i++)
      {
        // If the types differ, there must lie a switchpoint between these two classified points.
        if (currTypes[i] != currType)
        {
          double switchParam = FindSwitchPoint(medialAxisCurve, CornerPointList, BoundaryCurveList, lastParam, currParams[i], currType);
          medialAxisCurve2SwitchPointList[medialAxisCurve].Add(new SwitchPoint(switchParam, currType, currTypes[i]));
          currType = currTypes[i];
          lastParam = currParams[i];
        }
      }

      double firstFullLigParam = endIdx < currTypes.Count - 1 ? currParams[endIdx + 1] : 1.0;

      // Find last switch-point. Work from inside to outside.
      double endSwitchParam = 0.0;
      if (endIdx == currTypes.Count - 1)
      {
        Chord lastChord = GetChordParallel(medialAxisCurve.PointAt(currParams[endIdx]), BoundaryCurveList);
        endSwitchParam = FindEndSwitchPoint(medialAxisCurve, CornerPointList, BoundaryCurveList, currParams[endIdx], firstFullLigParam, currTypes[endIdx], lastChord, 0, selectedCurve);
      }
      else
      {
        // In this case we are far enough inside the curve (for reasonable initial sampling resolutions) s.t. we do not need to use the special treatment of the last case.
        endSwitchParam = FindSwitchPoint(medialAxisCurve, CornerPointList, BoundaryCurveList, currParams[endIdx], firstFullLigParam, currTypes[endIdx]);
      }
      medialAxisCurve2SwitchPointList[medialAxisCurve].Add(new SwitchPoint(endSwitchParam, currTypes[endIdx], 2));
    }

    ClassifiedPointList = queryPoints;
    TypeList = types;
    
    List<Point3d> switchPoints = new List<Point3d>();
    List<Line> chords = new List<Line>();
    foreach (KeyValuePair<Curve, List<SwitchPoint>> keyVal in medialAxisCurve2SwitchPointList)
    {
      foreach (SwitchPoint switchPoint in keyVal.Value)
      {
        switchPoints.Add(keyVal.Key.PointAt(switchPoint.param));
        Chord chord = GetChordParallel(keyVal.Key.PointAt(switchPoint.param), BoundaryCurveList);
        chords.Add(new Line(chord.points.Item1, chord.points.Item2));
      }
    }
    SwitchPointChords = chords;
    SwitchPointLocations = switchPoints;

    // Create surfaces.
    List<Brep> elementaryBreps = new List<Brep>();
    List<int> elementaryBrepTypes = new List<int>();
    List<Curve> faultySegs = new List<Curve>();
    List<Curve> segmentForEachSurf = new List<Curve>();
    List<string> typesForEachSurf = new List<string>();
    List<Curve> line0ForEachSurf = new List<Curve>();
    List<Curve> line1ForEachSurf = new List<Curve>();
    foreach (KeyValuePair<Curve, List<SwitchPoint>> keyVal in medialAxisCurve2SwitchPointList)
    {
      Curve medaxCurve = keyVal.Key;
      List<SwitchPoint> switches = keyVal.Value;
      if (switches[0].prevType != 2)
      {
        throw new Exception("First ligature type was not 2");
      }
      if (switches[switches.Count - 1].nextType != 2)
      {
        throw new Exception("Last ligature type was not 2");
      }
      if (switches.Count == 2)
      {
        if (switches[0].nextType == 2 && switches[1].prevType == 2)
        {
          continue;
        }
      }
      for (int i = 0; i < switches.Count - 1; i++)
      {
        Chord c0 = GetChordParallel(medaxCurve.PointAt(switches[i].param), BoundaryCurveList);
        Chord c1 = GetChordParallel(medaxCurve.PointAt(switches[i + 1].param), BoundaryCurveList);
        line0ForEachSurf.Add(c0.line);
        line1ForEachSurf.Add(c1.line);
        Curve currTrim = medaxCurve.Trim(switches[i].param, switches[i + 1].param);
        segmentForEachSurf.Add(medaxCurve.Trim(switches[i].param, switches[i + 1].param));
        typesForEachSurf.Add(switches[i].prevType + ", " + switches[i].nextType + ", " + switches[i + 1].prevType + ", " + switches[i + 1].nextType );
        if (currTrim != null)
        {
          if (currTrim.GetLength() < 0.1 && switches[i].nextType == 1 && ContainsPointParallel(currTrim.PointAtStart, BranchPointList, 0.1))
          {
            continue;
          }
        }

        List<Curve> edges = new List<Curve> { c0.line, c1.line }; // Contains the edges of the surface to be generated.

        // Case: the resulting face is triangular, i.e. two of the endpoints of each chord are identical.
        if (c0.points.Item1.DistanceTo(c1.points.Item1) < RhinoMath.SqrtEpsilon)
        {
          edges.Add(new LineCurve(c0.points.Item2, c1.points.Item2));
        }
        else if (c0.points.Item1.DistanceTo(c1.points.Item2) < RhinoMath.SqrtEpsilon)
        {
          edges.Add(new LineCurve(c0.points.Item2, c1.points.Item1));
        }
        else if (c0.points.Item2.DistanceTo(c1.points.Item1) < RhinoMath.SqrtEpsilon)
        {
          edges.Add(new LineCurve(c0.points.Item1, c1.points.Item2));
        }
        else if (c0.points.Item2.DistanceTo(c1.points.Item2) < RhinoMath.SqrtEpsilon)
        {
          edges.Add(new LineCurve(c0.points.Item1, c1.points.Item1));
        }
        else
        {
          // None of the chord-endpoints are identical, so we are dealing with a rectangular surface.

          // Here we need to check that we connect the endpoints such that the connecting lines do not cross.
          Curve sameA = new LineCurve(c0.points.Item1, c1.points.Item1);
          Curve sameB = new LineCurve(c0.points.Item2, c1.points.Item2);

          // Check intersection.
          if (Intersection.CurveCurve(sameA, sameB, RhinoMath.SqrtEpsilon, RhinoMath.SqrtEpsilon).Count == 0)
          {
            edges.Add(sameA);
            edges.Add(sameB);
          }
          else
          {
            // Then we need to connect the other way around.
            Curve diffA = new LineCurve(c0.points.Item1, c1.points.Item2);
            Curve diffB = new LineCurve(c0.points.Item2, c1.points.Item1);

            // Should not happen, but just to be sure.
            if (Intersection.CurveCurve(diffA, diffB, RhinoMath.SqrtEpsilon, RhinoMath.SqrtEpsilon).Count > 0)
            {
              throw new Exception("Connecting lines between chords cross both ways");
            }

            edges.Add(diffA);
            edges.Add(diffB);
          }
        }
        elementaryBreps.Add(Brep.CreateEdgeSurface(edges));
        if (switches[i].nextType != switches[i+1].prevType)
        {
          string allSwitches = "";
          foreach (SwitchPoint switchPoint in switches)
          {
            allSwitches += switchPoint.prevType + ", " + switchPoint.nextType + ", ";
          }
          faultySegs.Add(medaxCurve);
        }
        elementaryBrepTypes.Add(switches[i].nextType);
      }
    }
    FaultyCurves = faultySegs;
    segsToSurf = segmentForEachSurf;
    typesToSurf = typesForEachSurf;
    line0ToSurf = line0ForEachSurf;
    line1ToSurf = line1ForEachSurf;

    // Now we need to add the surfaces that correspond to branchpoints.
    List<Curve> checkLines = new List<Curve>();
    foreach (Point3d branchPoint in BranchPointList)
    {
      List<Curve> adjMedaxs = new List<Curve>();
      List<double> adjParams = new List<double>();
      foreach (Curve medax in MedialAxisCurveList)
      {
        double closestParam;
        medax.ClosestPoint(branchPoint, out closestParam);
        if (branchPoint.DistanceTo(medax.PointAt(closestParam)) < 0.05)
        {
          adjMedaxs.Add(medax);
          adjParams.Add(closestParam);
        }
      }

      // Generate the chord (on the correct side of the medial axis segment) for each medial axis segment that ends in this branchpoint.
      List<Chord> adjChords = new List<Chord>();
      for (int i = 0; i < adjMedaxs.Count; i++)
      {
        if (Math.Abs(adjMedaxs[i].Domain.Min - adjParams[i]) < Math.Abs(adjMedaxs[i].Domain.Max - adjParams[i]))
        {
          adjChords.Add(GetChordParallel(adjMedaxs[i].PointAt(medialAxisCurve2SwitchPointList[adjMedaxs[i]].First().param), BoundaryCurveList));
        }
        else
        {
          adjChords.Add(GetChordParallel(adjMedaxs[i].PointAt(medialAxisCurve2SwitchPointList[adjMedaxs[i]].Last().param), BoundaryCurveList));
        }
      }

      // Checking.
      List<Curve> currChords = new List<Curve>();
      foreach (Chord chord in adjChords)
      {
        currChords.Add(chord.line);
        checkLines.Add(chord.line);
      }
      elementaryBreps.Add(Brep.CreateEdgeSurface(currChords));
      elementaryBrepTypes.Add(2);
    }
    ElementarySurfacesList = elementaryBreps;
    ElementarySurfaceTypeList = elementaryBrepTypes;
    // CheckLines = checkLines;
# ---------- classifymedialaxissegments: C# additional code ----------
  public struct SwitchPoint
  {
    public SwitchPoint(double param, int prevType, int nextType)
    {
      this.param = param;
      this.prevType = prevType;
      this.nextType = nextType;
    }
    public double param;
    public int prevType;
    public int nextType;
  }

  public struct Chord
  {
    public Chord(Tuple<double, double> chordParams, Tuple<Curve, Curve> boundaryCurves, Tuple<Point3d, Point3d> chordPoints)
    {
      this.parameters = chordParams;
      this.curves = boundaryCurves;
      this.points = chordPoints;
      this.line = new LineCurve(chordPoints.Item1, chordPoints.Item2);
    }
    public Tuple<double, double> parameters;
    public Tuple<Curve, Curve> curves;
    public Tuple<Point3d, Point3d> points;
    public LineCurve line;
  }

  public struct PointOnCurve
  {
    public PointOnCurve(Curve curve, double param, Point3d point)
    {
      this.curve = curve;
      this.param = param;
      this.point = point;
    }
    public Curve curve;
    public double param;
    public Point3d point;
  }

  private int ClassifyMedialAxisPoint(Point3d medialAxisPoint, List<Point3d> CornerPointList, List<Curve> BoundaryCurveList)
  {
    // Find the two closest points on the boundary. The connecting line is called "chord", thus chordEnds.
    Chord chord = GetChordParallel(medialAxisPoint, BoundaryCurveList);

    // There are three types of medial-axis points:
    // 1. Chord-ends are both on a normal boundary segment, so not on a corner.
    // 2. Just one chord-end is a corner of the boundary, the other one is a normal segment.
    // 3. Both chord-ends are corners.
    bool isCorner0 = ContainsPointParallel(chord.points.Item1, CornerPointList, RhinoMath.SqrtEpsilon);
    bool isCorner1 = ContainsPointParallel(chord.points.Item2, CornerPointList, RhinoMath.SqrtEpsilon);
    if (!isCorner0 && !isCorner1)
    {
      return 0;
    }
    else if (isCorner0 && !isCorner1 || !isCorner0 && isCorner1)
    {
      return 1;
    }
    else
    {
      return 2;
    }
  }

  private double FindSwitchPoint(Curve medialAxisCurve, List<Point3d> cornerPointList, List<Curve> boundaryCurveList, double prevParam, double nextParam, int prevType)
  {
    // We test in the middle of the interval delimited by lowerParam and higherParam.
    double queryParam = 0.5 * (prevParam + nextParam);

    // We have reached reasonable accuracy.
    if (Math.Abs(queryParam - prevParam) <= RhinoMath.SqrtEpsilon)
    {
      return prevParam;
    }
    else
    {
      // Classify the query-point.
      int queryType = ClassifyMedialAxisPoint(medialAxisCurve.PointAt(queryParam), cornerPointList, boundaryCurveList);

      // If the queryType is different than the type associated with the lower interval parameter, then we have overshot the type-switchpoint and we
      // must sample in the interval [lowerParam, queryParam].
      if (queryType != prevType)
      {
        return FindSwitchPoint(medialAxisCurve, cornerPointList, boundaryCurveList, prevParam, queryParam, prevType);
      }

      // If the queryType is equal to the lowerType, we sample in the upper interval.
      else
      {
        return FindSwitchPoint(medialAxisCurve, cornerPointList, boundaryCurveList, queryParam, nextParam, prevType);
      }
    }
  }

  private double FindStartSwitchPoint(
    Curve medialAxisCurve, 
    List<Point3d> cornerPointList, 
    List<Curve> boundaryCurveList, 
    double prevParam, 
    double nextParam, 
    int nextType, 
    Chord oldChord)
  {
    // We test in the middle of the interval delimited by lowerParam and higherParam.
    double queryParam = 0.5 * (prevParam + nextParam);

    // We have reached reasonable accuracy.
    if (Math.Abs(nextParam - queryParam) <= RhinoMath.SqrtEpsilon)
    {
      return nextParam;
    }
    else
    {
      Point3d queryPoint = medialAxisCurve.PointAt(queryParam);
      Chord chord = GetChordParallel(queryPoint, boundaryCurveList);
      LineCurve chordLine = chord.line;

      // Condition 1: Medial axis crosses the segment in question.
      bool isIntersecting = Intersection.CurveCurve(medialAxisCurve, chordLine, RhinoMath.SqrtEpsilon, RhinoMath.SqrtEpsilon).Count > 0;

      // Condition 2: Types are the same.
      int currType = ClassifyMedialAxisPoint(queryPoint, cornerPointList, boundaryCurveList);
      bool typesAreSame = currType == nextType;

      // Condition 3: The closest boundary segments are the same.
      Curve old1 = oldChord.curves.Item1;
      Curve old2 = oldChord.curves.Item2;
      Curve new1 = chord.curves.Item1;
      Curve new2 = chord.curves.Item2;
      bool sameBoundary = old1 == new1 && old2 == new2 || old1 == new2 && old2 == new1;

      // If any of the conditions is not fulfilled, we are too close to the branchpoints and need to sample in the halfinterval which is farther away from branchpoint.
      if (!isIntersecting || !typesAreSame || !sameBoundary)
      {
        // We are too early on the line and need to subsample in the upper halfinterval.
        return FindStartSwitchPoint(medialAxisCurve, cornerPointList, boundaryCurveList, queryParam, nextParam, nextType, oldChord);
      }
      else
      {
        // The chord is still crossing the medial axis, so we can sample the lower halfinterval.
        return FindStartSwitchPoint(medialAxisCurve, cornerPointList, boundaryCurveList, prevParam, queryParam, nextType, chord);
      }
    }
  }
  private double FindEndSwitchPoint(
    Curve medialAxisCurve,
    List<Point3d> cornerPointList,
    List<Curve> boundaryCurveList,
    double prevParam,
    double nextParam,
    int nextType,
    Chord oldChord,
    int depth,
    Curve selectedCurve)
  {
    if (depth == 0)
    {
      Point3d queryPoint = medialAxisCurve.PointAt(prevParam);
      Chord chord = GetChordParallel(queryPoint, boundaryCurveList);
      CheckConditions(medialAxisCurve, queryPoint, chord, boundaryCurveList, cornerPointList, oldChord, nextType, selectedCurve);
    }

    // We test in the middle of the interval delimited by lowerParam and higherParam.
    double queryParam = 0.5 * (prevParam + nextParam);

    // We have reached reasonable accurary.
    if (Math.Abs(queryParam - prevParam) <= RhinoMath.SqrtEpsilon)
    {
      Point3d queryPoint = medialAxisCurve.PointAt(prevParam);
      Chord chord = GetChordParallel(queryPoint, boundaryCurveList);
      CheckConditions(medialAxisCurve, queryPoint, chord, boundaryCurveList, cornerPointList, oldChord, nextType, selectedCurve);
      return prevParam;
    }
    else
    {
      Point3d queryPoint = medialAxisCurve.PointAt(queryParam);
      Chord chord = GetChordParallel(queryPoint, boundaryCurveList);
      if (!CheckConditions(medialAxisCurve, queryPoint, chord, boundaryCurveList, cornerPointList, oldChord, nextType, selectedCurve))
      {
        return FindEndSwitchPoint(medialAxisCurve, cornerPointList, boundaryCurveList, prevParam, queryParam, nextType, oldChord, depth + 1, selectedCurve);
      }
      else
      {
        return FindEndSwitchPoint(medialAxisCurve, cornerPointList, boundaryCurveList, queryParam, nextParam, nextType, chord, depth + 1, selectedCurve);
      }
    }
  }

  private bool CheckConditions(Curve medialAxisCurve, Point3d queryPoint, Chord newChord, List<Curve> boundaryCurveList, List<Point3d> cornerPointList, Chord oldChord, int nextType, Curve selectedCurve)
  {
    LineCurve chordLine = newChord.line;

    // Condition 1: Medial axis crosses the segment in question.
    bool isIntersecting = Intersection.CurveCurve(medialAxisCurve, chordLine, RhinoMath.SqrtEpsilon, RhinoMath.SqrtEpsilon).Count > 0;

    // Condition 2: Types are the same.
    int currType = ClassifyMedialAxisPoint(queryPoint, cornerPointList, boundaryCurveList);
    bool typesAreSame = currType == nextType;

    // Condition 3: The closest boundary segments are the same.
    Curve old1 = oldChord.curves.Item1;
    Curve old2 = oldChord.curves.Item2;
    Curve new1 = newChord.curves.Item1;
    Curve new2 = newChord.curves.Item2;
    bool sameBoundary = old1 == new1 && old2 == new2 || old1 == new2 && old2 == new1;
    return isIntersecting && typesAreSame && sameBoundary;
  }

  private Chord GetChordParallel(Point3d queryPoint, List<Curve> boundaryCurveList)
  {
    PointOnCurve[] closestPoints = new PointOnCurve[boundaryCurveList.Count];  // Holds closest point on each boundary-segment to point on medial axis.
    double[] distances = new double[boundaryCurveList.Count];  // Holds the distances to the closest points.
    
    // Determine closest points on boundary segments and distances to them.
    System.Threading.Tasks.Parallel.For(0, boundaryCurveList.Count, i =>
    {
      double closestParam = 0.0;
      boundaryCurveList[i].ClosestPoint(queryPoint, out closestParam);
      Point3d closestPoint = boundaryCurveList[i].PointAt(closestParam);
      distances[i] = queryPoint.DistanceTo(closestPoint);
      closestPoints[i] = new PointOnCurve(boundaryCurveList[i], closestParam, closestPoint);
    });
    
    Array.Sort(distances, closestPoints);
    Point3d c0 = closestPoints[0].point;
    int idx = 1;
    while (idx < closestPoints.Length && c0.DistanceTo(closestPoints[idx].point) < 0.1)
    {
      idx++;
    }
    double param0 = closestPoints[0].param;
    double param1 = closestPoints[idx].param;
    Curve curve0 = closestPoints[0].curve;
    Curve curve1 = closestPoints[idx].curve;
    Point3d point0 = closestPoints[0].point;
    Point3d point1 = closestPoints[idx].point;
    return new Chord(new Tuple<double, double>(param0, param1), new Tuple<Curve, Curve>(curve0, curve1), new Tuple<Point3d, Point3d>(point0, point1));
  }

  private bool ContainsPointParallel(Point3d queryPoint, List<Point3d> pointList, double tol)
  {
    bool[] isClose = new bool[pointList.Count];
    System.Threading.Tasks.Parallel.For(0, pointList.Count, i =>
    {
      isClose[i] = queryPoint.DistanceTo(pointList[i]) < tol;
    });
    for (int i = 0; i < isClose.Length; i++)
    {
      if (isClose[i])
      {
        return true;
      }
    }
    return false;
  }
# ---------- end classifymedialaxissegments ----------
scriptpar_10 = ScriptParasite(Enable=toggle, Folder=panel)

number_slider_8 = Slider(43, range=0..196)
crv_13 = Curve(classifymedialaxissegments.segsToSurf)
brep = Brep(classifymedialaxissegments.ElementarySurfacesList)
panel_3 = Panel(classifymedialaxissegments.out)
item_10 = ListItem(List=brep, Index=number_slider_8, Wrap=True)
item_11 = ListItem(List=classifymedialaxissegments.line0ToSurf, Index=number_slider_8, Wrap=True)
item_12 = ListItem(List=classifymedialaxissegments.line1ToSurf, Index=number_slider_8, Wrap=True)
item_13 = ListItem(List=classifymedialaxissegments.typesToSurf, Index=number_slider_8, Wrap=True)
item_14 = ListItem(List=crv_13, Index=number_slider_8, Wrap=True)
panel_4 = Panel(item_13)
nodes = Point([nurse_station, patient_room, utility_room, elevator, elevator_lobby, medical_clinic, pantry, medication_room, janitor_closet])
crv_14 = Curve([classifymedialaxissegments.crv1, classifymedialaxissegments.crv2])
crv_15 = Curve([item_11, item_12])
cir_2 = Circle(Plane=classifymedialaxissegments.qPoint, Radius=classifymedialaxissegments.radius2)
crv_16 = Curve(classifymedialaxissegments.FaultyCurves)
previewlw_3 = CustomPreviewLineweights(Geometry=crv_15, Shader=ColourSwatch(SwatchColor=RGB(255, 0, 247)), Thickness=Slider(8.24, range=0..20), Absolute=False)
swatch = ColourSwatch(SwatchColor=RGB(0, 34, 255))
swatch_2 = ColourSwatch(SwatchColor=RGB(255, 229, 0))
swatch_3 = ColourSwatch(SwatchColor=RGB(255, 0, 0))
pt_3 = Point([classifymedialaxissegments.chord1, classifymedialaxissegments.chord2])
ln = Line(StartPoint=classifymedialaxissegments.chord1, EndPoint=classifymedialaxissegments.chord2)
srf = Surface(classifymedialaxissegments.BranchPointBoundaries)
dots = DotDisplay(Point=classifymedialaxissegments.qPoint, Colour=ColourSwatch(SwatchColor=RGB(255, 0, 0)), Size=Slider(0.265, range=0..1))
cir_3 = Circle(Plane=classifymedialaxissegments.qPoint, Radius=classifymedialaxissegments.radius1)
typetocolor = GhPythonScript(Type=classifymedialaxissegments.ElementarySurfaceTypeList, NormalColor=swatch, SemiColor=swatch_3, FullColor=swatch_2)  # -> out, Color; inputs NormalColor: Color, SemiColor: Color, FullColor: Color
# ---------- typetocolor: Python ----------
__author__ = "rapha"
__version__ = "2021.10.10"

import rhinoscriptsyntax as rs

if Type == 0:
    Color = NormalColor
elif Type == 1:
    Color = SemiColor
else:
    Color = FullColor
# ---------- end typetocolor ----------
typetocolor_2 = GhPythonScript(Type=classifymedialaxissegments.TypeList, NormalColor=swatch, SemiColor=swatch_3, FullColor=swatch_2)  # -> out, Color; inputs NormalColor: Color, SemiColor: Color, FullColor: Color; same code as typetocolor
line = Line(classifymedialaxissegments.Chords)
material_2 = CreateMaterial(
    Diffuse=typetocolor.Color,
    Specular=RGB(255, 255, 255),
    Emission=RGB(0, 0, 0),
    Transparency=Slider(0.43, range=0..1),
    Shine=0)
medial_axis_classifier = GhPythonScript(corners=disc.Points, boundary_curves=boundary_curves)  # -> out, segment_curves, segment_types, convex_surfaces, closest_branchpoint; inputs corners: list of Point3d, medial_axis_curves: list of Curve, boundary_curves: list, branch_points: list of Point3d; disabled
# ---------- medial_axis_classifier: Python ----------
__author__ = "rapha"
__version__ = "2021.09.06"

import rhinoscriptsyntax as rs
import ghpythonlib.parallel as para
import time

class MedialAxisSegment:
    def __init__(self,
                 start_point_descriptor,
                 end_point_descriptor,
                 over_true_time):
        
        # Start and endpoint must be from the same medial axis to form valid segment.
        if (start_point_descriptor.medial_axis != end_point_descriptor.medial_axis):
            raise Exception("Start- and end-point were not extracted from the same medial axis curve")
        
        self.start_pd = start_point_descriptor
        self.end_pd = end_point_descriptor
        self.segment_curve = self.get_segment_curve()
        self.type = self.get_segment_type()
        self.over_true_time = over_true_time
    
    def get_segment_curve(self):
        medial_axis = self.start_pd.medial_axis
        start_time = self.start_pd.time
        end_time = self.end_pd.time
        if (start_time == end_time):
            return None
        return rs.AddSubCrv(medial_axis, start_time, end_time)
    
    def get_segment_type(self):
        return self.end_pd.type
   
    def get_start_time(self):
        return self.start_pd.time
    
    def get_end_time(self):
        return self.end_pd.time
    
    def get_start_point(self):
        medial_axis = self.start_pd.medial_axis
        start_time = self.start_pd.time
        return rs.EvaluateCurve(medial_axis, start_time)
    
    def get_end_point(self):
        medial_axis = self.end_pd.medial_axis
        end_time = self.end_pd.time
        return rs.EvaluateCurve(medial_axis, end_time)
    
    def get_start_symm_chord(self):
        return rs.AddLine(self.start_pd.equi_point_1, self.start_pd.equi_point_2)
    
    def get_end_symm_chord(self):
        return rs.AddLine(self.end_pd.equi_point_1, self.end_pd.equi_point_2)
    
    def is_adjacent_to_branch_point(self, branch_point, tol):
        start_is_close = rs.Distance(self.get_start_point(), branch_point) < tol
        end_is_close = rs.Distance(self.get_end_point(), branch_point) < tol
        return start_is_close or end_is_close
    
    def get_convex_surface(self):
        sp1 = self.start_pd.equi_point_1
        sp2 = self.start_pd.equi_point_2
        ep1 = self.end_pd.equi_point_1
        ep2 = self.end_pd.equi_point_2
        points = [sp1, sp2, ep1, ep2]
        
        # List which will contain boundaries of convex shape.
        lines = []
        sp1_sp2_tiny = rs.IsVectorTiny(rs.VectorSubtract(sp1, sp2))
        ep1_ep2_tiny = rs.IsVectorTiny(rs.VectorSubtract(ep1, ep2))
        sp1_ep1_tiny = rs.IsVectorTiny(rs.VectorSubtract(sp1, ep1))
        sp2_ep2_tiny = rs.IsVectorTiny(rs.VectorSubtract(sp2, ep2))
        sp1_ep2_tiny = rs.IsVectorTiny(rs.VectorSubtract(sp1, ep2))
        sp2_ep1_tiny = rs.IsVectorTiny(rs.VectorSubtract(sp2, ep1))
        
        # Symmetric choords should never be points (if approximated).
        if (sp1_sp2_tiny or ep1_ep2_tiny or sp1_ep2_tiny or sp2_ep1_tiny):
            return None
        
        # If the points on either side are identical, and on the other side they
        # are not, then the convex shape is a triangle.
        elif (sp1_ep1_tiny and not sp2_ep2_tiny):
            lines.append(rs.AddLine(sp2, ep2))
            lines.append(rs.AddLine(sp1, sp2))
            lines.append(rs.AddLine(ep1, ep2))
        elif (sp2_ep2_tiny and not sp1_ep1_tiny):
            lines.append(rs.AddLine(sp1, ep1))
            lines.append(rs.AddLine(sp1, sp2))
            lines.append(rs.AddLine(ep1, ep2))
        
        # If all points are distinct, the surface is a quadrilateral.
        elif (not sp1_ep1_tiny and not sp2_ep2_tiny):
            # Diagonal check.
            temp_conn_1 = rs.AddLine(sp1, ep1)
            temp_conn_2 = rs.AddLine(sp2, ep2)
            if (rs.CurveCurveIntersection(temp_conn_1, temp_conn_2)):
                temp = ep1
                ep1 = ep2
                ep2 = temp
            lines.append(rs.AddLine(sp1, sp2))
            lines.append(rs.AddLine(sp2, ep2))
            lines.append(rs.AddLine(ep2, ep1))
            lines.append(rs.AddLine(ep1, sp1))
        else:
            return None
        # Else we are in a degenerate case which is a bug.
        """
        else:
            raise Exception("All points are equal. This should be the case")
        """
        # Now we can construct the surface.
        srf = rs.AddPlanarSrf(lines)
        if (srf):
            return srf[0]
        else:
            return None


class MedialAxisPointDescriptor:
    def __init__(self,
                 medial_axis,
                 time,
                 type,
                 equi_point_1,
                 equi_point_2,
                 boundary_segment_id_1,
                 boundary_segment_id_2):
        self.medial_axis = medial_axis
        self.time = time
        self.type = type
        
        # Check if equidistant points are distinct.
        """
        if (rs.PointCompare(equi_point_1, equi_point_2)):
            raise Exception("Equidistant points are same in MedialAxisPointDescriptor construction")
        """
        
        self.equi_point_1 = equi_point_1
        self.equi_point_2 = equi_point_2
        self.boundary_segment_id_1 = boundary_segment_id_1
        self.boundary_segment_id_2 = boundary_segment_id_2


def are_points_distinct(pd1, pd2):
    """
    Checks whether two points on the medial axis belong to different segments.
    
    Parameters
    ----------
    pd1 : MedialAxisPointDescriptor
        Descriptor of the first point to compare.
    pd2 : MedialAxisPointDescriptor
        Descriptor of the second point to compare.
    
    Returns
    -------
    bool
        True if either the points belong to different segment types or if the 
        their closest boundary-segments are distinct. False otherwise.
   """
    
    # First check if the points are of the same type.
    if (pd1.type != pd2.type):
        return True
    
    if (pd1.boundary_segment_id_1 != pd2.boundary_segment_id_1 or
        pd1.boundary_segment_id_2 != pd2.boundary_segment_id_2):
        return True
    
    # Otherwise the points lie on the same segment.
    return False


def are_segments_distinct(s1, s2):
    """
    Checks if two segments are distinct.
    
    Parameters
    ----------
    s1 : MedialAxisSegment
        Descriptor of the first segment to compare.
    s2 : MedialAxisSegment
        Descriptor of the second segment to compare.
    
    Returns
    -------
    bool
        True if the segments are distinct (False otherwise), i.e. if their 
        start- and end-locations are distinct (the flipped order is also 
        checked, in case one segment is just a reversed version of the other). 
        TODO: Implement a better check as soon as generate_segment implements
        more accurate way of classifying segment. Current check should be
        sufficient though.
    """
    start1 = s1.get_start_point()
    end1 = s1.get_end_point()
    start2 = s2.get_start_point()
    end2 = s2.get_end_point()
    
    # TODO: Current tolerance is quite large, find better way to set it.
    same_dir = rs.Distance(start1, start2) < 0.5 and rs.Distance(end1, end2) < 0.5
    oppo_dir = rs.Distance(start1, end2) < 0.5 and rs.Distance(end1, start2) < 0.5
    
    return not same_dir and not oppo_dir
 
 
def generate_segments(medial_axis, corners, boundary_segments, stepsize, tolerance):
    """
    Segments and classifies the medial axis.
    
    Parameters
    ----------
    medial_axis : Curve
        Curve that corresponds to the medial axis.
    corners: [Point]
        Points that correspond to the corners of the boundary curves.
    boundary_segments: [Curve]
        Curves that correspond to the exploded boundary. One element must 
        represent a single straight wall.
    stepsize: float
        Stepsize with which the medial axis should be iterated over initially.
    tolerance: float
        Maximal error tolerated when determining end/start-point of a segment.
    
    Raises
    ------
        Raises exception if program is assumed to be in an infinity loop. This
        happens after 10'000 iterations of the stepping procedure and can
        produce false positives.
    
    Returns
    -------
    [MedialAxisSegment]
        Each element corresponds to a segment of the medial axis. Segments are
        unique, but in no particular order.
    """
    
    # Start at the beginning of the medial axis.
    last_seg = generate_segment(medial_axis, 
                                0.0,
                                0.0,
                                corners,
                                boundary_segments,
                                stepsize,
                                tolerance)
    
    segments = []
    
    # TODO: Remove after more testing.
    # Prevents script of getting stuck in while loop.
    iter = 0
    max_iter = 1000
    
    # Step through medial axis and create segments. We can assume that the last
    # segment will have end-time >= 1.0, so we can stop if that occurs.
    safe_time = 0.0
    time = 0.0
    while (safe_time < 1.0):
        
        # The safe_time should always underestimate the real time.
        if (safe_time > time):
            print "safe_time: " + str(safe_time)
            print "time: " + str(time)
            raise Exception("Safe time was larger than actual time")
        
        # TODO: Remove after more testing.
        iter += 1
        if (iter > max_iter):
            raise Exception("Probably stuck in a while loop")
        
        # Create next segment starting from the end-time of last segment.
        # We can do this as the last segment will always overshoot the true
        # segment end by a bit ==> will not get stuck at same end as before.
        curr_seg = generate_segment(medial_axis,
                                    safe_time,
                                    time,
                                    corners,
                                    boundary_segments,
                                    stepsize,
                                    tolerance)
        
        segments.append(curr_seg)
        
        # Always update time, otherwise do not move on medial axis.
        safe_time = curr_seg.get_end_time()
        time = curr_seg.over_true_time
    
    return segments


def generate_segment(medial_axis, safe_time, time, corners, boundary_segments, stepsize, tolerance):
    """
    Finds a single segment on the medial axis from some starting time onwards.
    
    Parameters
    ----------
    medial_axis : Curve
        See generate_segments.
    time : float
        Parameter at which to begin this segment on medial axis.
    corners : [Point]
        See generate_segments.
    boundary_segments: [Curve]
        See generate_segments.
    stepsize:
        See generate_segments.
    tolerance:
        See generate_segments.
        
    Raises
    ------
        See generate_segments.
    
    Returns
    -------
    MedialAxisSegment
        The segment of the medial axis starting at parameter time.
    """
    
    # Information about the start point of the segment.
    # "pd" is short for point-descriptor.
    start_pd = classify_point(medial_axis, time, corners, boundary_segments)
    
    # The point-descriptor which is still on the current segment.
    curr_pd = start_pd
    next_pd = None
    
    # Initial step.
    next_time = time + stepsize
    
    # Iterate over medial_axis until either:
    # 1. the stepsize is smaller than our error-tolerance.
    # 2. the end of the medial axis was reached.
    
    # TODO: Remove after more testing.
    max_iter = 10000
    iter = 0
    over_true_time = 0.0
    while (stepsize > tolerance and time <= 1.0):
        
        # TODO: Remove after more testing.
        iter += 1
        if (iter > max_iter):
            raise Exception("Probably stuck in a while loop")
        
        # Get the point-descriptor at the next step.
        next_pd = classify_point(medial_axis, next_time, corners, boundary_segments)
        
        # Check if the current and next point belong to the same segment, else
        # we reduce the step-size. Else, we are safe to progress to the next 
        # time point.
        if (are_points_distinct(curr_pd, next_pd)):
            over_true_time = next_time
            # TODO: Find better way to reduce step-size.
            stepsize /= 2.0
        else:
            curr_pd = next_pd
            time = next_time
        next_time = time + stepsize
    
    # We might have left the while loop because we reached the end of the medial
    # line ==> we could make our result more accurate by evaluating at the end
    # the medial axis.
    if (time > 1.0):
        next_pd = classify_point(medial_axis, 1.0, corners, boundary_segments)
    
    # Construct and return a new segment-descriptor from the start- and end-points.
    medial_axis_segment = MedialAxisSegment(start_pd, curr_pd, over_true_time)
    
    return medial_axis_segment


def are_points_distinct(pd1, pd2):
    """
    Checks whether two points on the medial axis belong to different segments.
    
    Parameters
    ----------
    pd1 : MedialAxisPointDescriptor
        Descriptor of the first point to compare.
    pd2 : MedialAxisPointDescriptor
        Descriptor of the second point to compare.
    
    Returns
    -------
    bool
        True if either the points belong to different segment types or if the 
        their closest boundary-segments are distinct. False otherwise.
   """
    
    # First check if the points are of the same type.
    if (pd1.type != pd2.type):
        return True
    
    if (pd1.boundary_segment_id_1 != pd2.boundary_segment_id_1 or
        pd1.boundary_segment_id_2 != pd2.boundary_segment_id_2):
        return True
    
    # Otherwise the points lie on the same segment.
    return False


def classify_point(medial_axis, time, corners, boundary_segments):
    """
    Classifies the medial-axis-segment-type of the point.
    
    Parameters
    ----------
    medial_axis : Curve
        See generate_segments.
    time : float
        Parameter of the point to be evaluated on the medial axis.
    corners : [Point]
        See generate_segments.
    boundary_segments : [Curve]
        See generate_segments.
    
    Returns
    -------
    MedialAxisPointDescriptor
        Descriptor of the point on the medial axis.
    """
    
    # Extract the point on the medial axis.
    point = rs.EvaluateCurve(medial_axis, time)
    
    # Find the closest points.
    closest_points = [rs.EvaluateCurve(x, rs.CurveClosestPoint(x, point)) for x in boundary_segments]
    
    # Calculate distances to closest points.
    distances = [rs.Distance(x, point) for x in closest_points]
    
    # Combine points, distances, corresponding segments into list.
    # Also add indices to allow for reordering of segments in point-descriptor 
    # construction.
    equi_point_descs = zip(distances, 
                           closest_points, 
                           boundary_segments, 
                           list(range(len(boundary_segments))))
    
    # Sorting not necessary, since we only need to extract the two smallest distances. 
    # First, find point with closest distance.
    symm_chord_desc = []
    min_dist = equi_point_descs[0][0]
    min_equi_pt = equi_point_descs[0]
    min_idx = 0
    for i in range(1, len(equi_point_descs)):
        if (min_dist > equi_point_descs[i][0]):
            min_dist = equi_point_descs[i][0]
            min_equi_pt = equi_point_descs[i]
            min_idx = i
    symm_chord_desc.append(min_equi_pt)
    del equi_point_descs[min_idx]
    
    # Find second closest point.
    min_dist = float("inf")
    min_equi_pt = None
    for i in range(len(equi_point_descs)):
        
        # Now we also need to check whether the second point is indeed distinct.
        if (min_dist > equi_point_descs[i][0] and rs.Distance(equi_point_descs[i][1], symm_chord_desc[0][1]) > 0.1):
            min_dist = equi_point_descs[i][0]
            min_equi_pt = equi_point_descs[i]
    symm_chord_desc.append(min_equi_pt)
    
    # Reorder primitive descriptors based on segment id.
    if (symm_chord_desc[0][3] > symm_chord_desc[1][3]):
        symm_chord_desc = [symm_chord_desc[1], symm_chord_desc[0]]
    
    # Check if points are corners.
    p1 = symm_chord_desc[0][1]
    p2 = symm_chord_desc[1][1]
    p1_is_corner = [rs.PointCompare(x, p1) for x in corners]
    p2_is_corner = [rs.PointCompare(x, p2) for x in corners]
    p1_is_corner = any(p1_is_corner)
    p2_is_corner = any(p2_is_corner)
    
    # Classify segment.
    type = "unknown"
    if (not p1_is_corner and not p2_is_corner):
        type = "normal"
    elif (p1_is_corner != p2_is_corner):
        type = "semi-ligature"
    else:
        type = "full-ligature"
    
    # Construct and return point descriptor.
    point_descriptor = MedialAxisPointDescriptor(medial_axis,
                                                 time,
                                                 type,
                                                 p1,
                                                 p2,
                                                 symm_chord_desc[0][3],
                                                 symm_chord_desc[1][3])
    return point_descriptor


def assign_color(seg, normal, semi, full):
    if seg.type == "normal":
        return normal
    elif seg.type == "semi-ligature":
        return semi
    else:
        return full


def generate_boundary_segments(boundary_curves):
    """
    Creates a set of boundary curves, each corresponding to a wall.
    """
    boundary_segments = []
    for boundary_curve in boundary_curves:
        
        # Assuming explode-curves generates segments that are adjacent.
        raw_segments = rs.ExplodeCurves(boundary_curve)
        start_idx = len(boundary_segments)
        
        unjoined = [raw_segments[0]]
        for i in range(1, len(raw_segments)):
            curr_seg = raw_segments[i]
            last_seg = unjoined[len(unjoined) - 1]
            curr_vec = rs.VectorSubtract(rs.CurveEndPoint(curr_seg), rs.CurveStartPoint(curr_seg))
            last_vec = rs.VectorSubtract(rs.CurveEndPoint(last_seg), rs.CurveStartPoint(last_seg))
            if (not rs.IsVectorParallelTo(curr_vec, last_vec)):
                if (len(unjoined) >= 2):
                    boundary_segments.append(rs.JoinCurves(unjoined)[0])
                else:
                    boundary_segments.append(last_seg)
                
                # Since the was a discontinuity, we need to delete all previous
                # joinable segments.
                del unjoined[:]
            unjoined.append(curr_seg)
        
        # Add the remaining segments.
        if (len(unjoined) >= 2):
            boundary_segments.append(rs.JoinCurves(unjoined)[0])
        else:
            boundary_segments.append(unjoined[len(unjoined) - 1])
    return boundary_segments

def find_stepsize_tolerance(medial_axis):
    medial_axis_len = rs.CurveLength(medial_axis)
    steps = medial_axis_len / initial_stepsize
    stepsize = 1.0 / steps
    tolerance = stepsize / displacement_tol_fac
    return [stepsize, tolerance]


def is_adjacent_to_branch_point(segment, branch_points, tol):
    adj = [segment.is_adjacent_to_branch_point(bp, tol) for bp in branch_points]
    bps = []
    if any(adj):
        for i in range(len(branch_points)):
            if adj[i]:
                bps.append(branch_points[i])
    else:
        return []


start_time = time.time()

# Divide boundary curves into boundary segments.
boundary_segments = generate_boundary_segments(boundary_curves)

# Go through each medial axis and extract segments.
segments = para.run(lambda x: generate_segments(x, corners, boundary_segments, find_stepsize_tolerance(x)[0], find_stepsize_tolerance(x)[1]), medial_axis_curves, True)

segment_curves = [seg.segment_curve for seg in segments]
segment_types = [seg.type for seg in segments]
convex_surfaces = []
for seg in segments:
    try:
        print "here"
        convex_surfaces.append(seg.get_convex_surface())
    except:
        convex_surfaces.append(None)
"""
try:
    convex_surfaces = [seg.get_convex_surface() for seg in segments]
except:
    pass
closest_branchpoint = para.run(lambda x: is_adjacent_to_branch_point(x, branch_points, 0.1), segments, False)
"""
print "Number of segments generated: " + str(len(segments))
end_time = time.time()
print "Total time: " + str(end_time - start_time)
# ---------- end medial_axis_classifier ----------
line_2 = Line(classifymedialaxissegments.SwitchPointChords)
dots_2 = DotDisplay(Point=classifymedialaxissegments.ClassifiedPointList, Colour=typetocolor_2.Color, Size=Slider(2, range=0..10))
preview = CustomPreview(Geometry=classifymedialaxissegments.ElementarySurfacesList, Material=material_2)
srf_2 = Surface(medial_axis_classifier.convex_surfaces)
panel_5 = Panel(medial_axis_classifier.out)
createconvexpartition = GhPythonScript(
    medax_sgmts=medial_axis_classifier.segment_curves,
    convex_srfs=medial_axis_classifier.convex_surfaces,
    tps=medial_axis_classifier.segment_types,
    closest_branchpoint=medial_axis_classifier.closest_branchpoint,
    boundary_crvs=layout_curves)  # -> out, nodes, edges, srfs, colors, segs, degrees; inputs medax_sgmts: list of Curve, convex_srfs: list of Brep, tps: list, layout_srf: Brep, closest_branchpoint: list, branch_points: list of Point3d, boundary_crvs: list of Curve, min_radii: list; disabled
# ---------- createconvexpartition: Python ----------
__author__ = "rapha"
__version__ = "2021.09.20"

import rhinoscriptsyntax as rs
import time
import ghpythonlib.parallel as para
import ghpythonlib.components as ghcomp
import ghpythonlib.treehelpers as th
import Rhino.Geometry
from itertools import chain, combinations
import random
import math

class Node():
    
    def __init__(self, sgmt, srf, tp, bp):
        if isinstance(sgmt, list):
            self.sgmt = sgmt
        else:
            self.sgmt = [sgmt]
        self.srf = srf
        self.tp = tp
        self.bp = bp
        self.centroid = self.get_centroid()
    
    def get_centroid(self):
        if not self.srf:
            self.centroid = None
            return
        return rs.SurfaceAreaCentroid(self.srf)[0]


def flatten(l):
    return [item for sublist in l for item in sublist]


def are_nodes_adjacent(node1, node2, tol):
    sgmts1 = node1.sgmt
    sgmts2 = node2.sgmt
    for sgmt1 in sgmts1:
        for sgmt2 in sgmts2:
            are_sgmts_adj = are_crvs_adjacent(sgmt1, sgmt2, tol)
            if are_sgmts_adj:
                return True
    return False


def are_crvs_adjacent(crv1, crv2, tol):
    s1 = rs.CurveStartPoint(crv1)
    e1 = rs.CurveEndPoint(crv1)
    s2 = rs.CurveStartPoint(crv2)
    e2 = rs.CurveEndPoint(crv2)
    hd_hd = rs.Distance(s1, s2) < tol
    hd_tl = rs.Distance(s1, e2) < tol
    tl_hd = rs.Distance(e1, s2) < tol
    tl_tl = rs.Distance(e1, e2) < tol
    return hd_hd or hd_tl or tl_hd or tl_tl or rs.CurveCurveIntersection(crv1, crv2)


def is_srf_covered(srf1, srf2, tol):
    points = srf2.DuplicateVertices()
    closest_params = [rs.SurfaceClosestPoint(srf1, point) for point in points]
    closest_points = [rs.EvaluateSurface(srf1, param[0], param[1]) for param in closest_params]
    distances = [rs.Distance(point, closest_point) for (point, closest_point) in zip(points, closest_points)]
    return all([dist < tol for dist in distances])


def visualize_graph(graph):
    centroids = []
    edges = []
    for node in graph:
        if node.srf:
            centroids.append(node.centroid)
    for node in graph:
        if not node.srf:
            continue
        for neighbor in graph[node]:
            if not neighbor.srf:
                continue
            else:
                try:
                    edges.append(rs.AddLine(node.centroid, neighbor.centroid))
                except:
                    continue
    return centroids, edges


def are_points_far_from_curve(curve, points, tol):
    closest_params = [rs.CurveClosestPoint(curve, point) for point in points]
    closest_points = [rs.EvaluateCurve(curve, param) for param in closest_params]
    distances = [rs.Distance(closest_point, point) for (closest_point, point) in zip(closest_points, points)]
    return any([dist > tol for dist in distances])


def merge_same_tp_nodes(graph, tp):
    nodes = [node for node in graph]
    for node in nodes:
        if node.tp != tp:
            continue
        try:
            graph[node]
        except:
            continue
        # Find maximal connected subgraph starting from current node of tp.
        queue = [node]
        visited = []
        neighbors = []
        while len(queue) > 0:
            curr_node = queue.pop()
            if curr_node in visited:
                continue
            visited.append(curr_node)
            for neighbor in graph[curr_node]:
                if neighbor in visited:
                    continue
                if neighbor.tp != tp:
                    if neighbor not in neighbors:
                        neighbors.append(neighbor)
                    continue
                queue.append(neighbor)
        
        # Solitary normal surface.
        if len(visited) == 1:
            continue
        
        # Should not happen, but we need to check if the set of corners is convex.
        if not are_nodes_convex(visited, 0.1):
            continue
        
        # Create new node by combining surfaces and joining segments.
        new_node = merge_nodes(visited, tp)
        
        # Remove old nodes and maintain connection.
        for visit in visited:
            remove_node(graph, visit)
        graph[new_node] = neighbors
        for neighbor in neighbors:
            graph[neighbor].append(new_node)


def powerset(iterable):
    s = list(iterable)
    return chain.from_iterable(combinations(s, r) for r in range(len(s)+1))


def are_nodes_convex(nodes, tol):
    """
    Compares points to their convex hull. If the distance is too large,
    point is set is is assumed to not be convex.
    """
    try:
        corners = [node.srf.DuplicateVertices() for node in nodes]
    except:
        print [node.srf for node in nodes]
        raise Exception("Fodes")
    corners_flat = flatten(corners)
    return are_points_convex(corners_flat, tol)


def are_points_convex(points, tol):
    convex_hull = ghcomp.ConvexHull(points)[0]
    return not are_points_far_from_curve(convex_hull, points, tol)


def simple_srf_compare(srf1, srf2):
    return rs.Distance(rs.SurfaceAreaCentroid(srf1)[0], rs.SurfaceAreaCentroid(srf2)[0]) < 0.1


def remove_node(graph, node):
    del graph[node]
    for remaining in graph:
        if node in graph[remaining]:
            graph[remaining].remove(node)


def join_srfs(nodes):
    """
    Creates a surface covering all surfaces corresponding to nodes.
    """
    srfs = [node.srf for node in nodes]
    corners = flatten([srf.DuplicateVertices() for srf in srfs])
    return create_srf_from_points(corners)


def create_srf_from_points(points):
    convex_hull = ghcomp.ConvexHull(points)[0]
    srf = rs.AddPlanarSrf([convex_hull])
    if srf:
        return rs.coercebrep(srf[0])
    else:
        return None


def merge_branchpoints(nodes):
    bps = flatten([node.bp for node in nodes])
    return list(set(bps))


def is_adjacent_to_branchpoint(sgmt, branch_point, tol):
    start_is_close = rs.Distance(rs.CurveStartPoint(sgmt), branch_point) < tol
    end_is_close = rs.Distance(rs.CurveEndPoint(sgmt), branch_point) < tol
    return start_is_close or end_is_close


def merge_nodes(nodes, tp):
    new_srf = join_srfs(nodes)
    if not new_srf:
        raise Exception("Null surface created.")
    new_sgmt = flatten([node.sgmt for node in nodes])
    bps = []
    for node in nodes:
        for b in node.bp:
            if not b in bps:
                bps.append(b)
    return Node(new_sgmt, new_srf, tp, bps)


def merge_around_ligature(graph, ligature_node):
    if not ligature_node.srf:
        return
    # Get all normal-neighbors.
    norm_neighbors = [node for node in graph[ligature_node] if (node.tp == "normal" and node.srf)]
    if len(norm_neighbors) == 0:
        return
    
    # Get all subsets of neighbors.
    subsets = powerset(norm_neighbors)
    
    # For each subset of nodes, check if merged node would be convex.
    # If so, remember the size of the merged node and eventually select the merge
    # which yields the largest convex space.
    max_subset = None
    max_area = 0.0
    for subset in subsets:
        subset = list(subset)
        if len(subset) == 0:
            continue
        to_be_merged = [ligature_node] + subset
        if not are_nodes_convex(to_be_merged, 0.1):
            continue
        new_srf = join_srfs(to_be_merged)
        new_area = rs.SurfaceArea(new_srf)
        if rs.SurfaceArea(new_srf) > max_area:
            max_subset = to_be_merged
            max_area = new_area
    if not max_subset:
        print "No subset of nodes was found."
        return
    
    # Neighbors adjacent to nodes being removed (remove all that are actually in
    # the subset to be removed.
    new_neighbors = flatten([graph[n] for n in max_subset])
    for old in max_subset:
        new_neighbors = [neigh for neigh in new_neighbors if neigh != old]
    
    # Remove old nodes and add new one.
    for node in max_subset:
        remove_node(graph, node)
    new_node = merge_nodes(max_subset, "normal")
    graph[new_node] = new_neighbors
    for neigh in new_neighbors:
        try:
            graph[neigh].append(new_node)
        except:
            continue
    return new_node


def create_order(semi, min_radii):
    if len(semi.bp) == 0:
        return float("inf")
    elif len(semi.bp) == 1:
        return min_radii[semi.bp[0]]
    else:
        return min([min_radii[idx] for idx in semi.bp])


def input_preprocessing(medax_sgmts, convex_srfs, tps):
    input_data = zip(medax_sgmts, convex_srfs, tps)
    filtered_data = filter(lambda x: x[0] and rs.CurveLength(x[0]) > 0.5, input_data)
    data = []
    for d in filtered_data:
        if d[2] == "full-ligature":
            data.append(d)
            continue
        if not d[1]:
            continue
        data.append(d)
    print "lost " + str(len(filtered_data) - len(data)) + " segments."
    unzipped_data = zip(*data)
    medax_sgmts, convex_srfs, tps = unzipped_data[0], unzipped_data[1], unzipped_data[2]
    return medax_sgmts, convex_srfs, tps


def branchpoint_adjacency(medax_sgmts, branch_points):
    closest_branchpoint = []
    for sgmt in medax_sgmts:
        bps = []
        for i in range(len(branch_points)):
            if is_adjacent_to_branchpoint(sgmt, branch_points[i], 0.1):
                bps.append(i)
        closest_branchpoint.append(bps)
    return closest_branchpoint


def remove_invalid_srfs(nodes, boundary_crvs, layout_srf):
    new_nodes = []
    for node in nodes:
        if not node.centroid:
            new_nodes.append(node)
            continue
        
        # Remove nodes whose centroid is too close to the boundary.
        closest_params = [rs.CurveClosestPoint(boundary_crv, node.centroid) for boundary_crv in boundary_crvs]
        closest_points = [rs.EvaluateCurve(boundary_crv, closest_param) for (closest_param, boundary_crv) in zip(closest_params, boundary_crvs)]
        distances = [rs.Distance(node.centroid, closest_point) for closest_point in closest_points]
        if any([dist < 0.05 for dist in distances]):
            continue
        if rs.IsPointOnSurface(layout_srf, node.centroid):
            new_nodes.append(node)
    return new_nodes


def create_graph(nodes):
    graph = {}
    for node in nodes:
        graph[node] = []
    for i in range(len(nodes)):
        node1 = nodes[i]
        for j in range(len(nodes)):
            if i == j:
                continue
            node2 = nodes[j]
            if (are_nodes_adjacent(node1, node2, 0.25)):
                graph[node1].append(node2)
    return graph


def merge_around_semi_ligs(graph):
    semis = [node for node in graph if node.tp == "semi-ligature"]
    radii = [create_order(semi, min_radii) for semi in semis]
    
    # Order semi-ligatures by descending size of their maximally inscribed circles.
    semis_radii = zip(semis, radii)
    semis_radii = sorted(semis_radii, key=lambda x: x[1], reverse=True)
    semis = zip(*semis_radii)[0]
    for i in range(len(semis)):
        semi = semis[i]
        merge_around_ligature(graph, semi)


def create_full_lig_graph(graph):
    full_lig_graph = {}
    # Populate graph with nodes that correspond to full ligatures.
    for node in graph:
        if node.tp == "full-ligature":
            full_lig_graph[node] = []
    
    # For each full-ligature node, start BFS and add all nodes that are reached and 
    # are of tp full-ligature.
    for full_lig_node in full_lig_graph:
        visited = []
        queue = [full_lig_node]
        visited = []
        while len(queue) > 0:
            curr_node = queue.pop()
            if curr_node in visited:
                continue
            visited.append(curr_node) 
            for neighbor in graph[curr_node]:
                if neighbor in visited:
                    continue
                if neighbor.tp == "full-ligature":
                    queue.append(neighbor)
        full_lig_graph[full_lig_node] = visited
    return full_lig_graph


def create_full_lig_edges(graph, full_lig_graph):
    node_to_not_adj = {}
    nodes = [node for node in graph]
    for i in range(len(nodes)):
        node1 = nodes[i]
        if node1.tp == "full-ligature":
            continue
       
        # Only consider nodes which are adjacent to segments that are full-ligatures.
        neighbors1 = filter(lambda neighbor: neighbor.tp == "full-ligature", graph[node1])
        if len(neighbors1) == 0:
            continue
        for j in range(len(nodes)):
            if i == j:
                continue
            node2 = nodes[j]
            if node2.tp == "full-ligature":
                continue
            neighbors2 = filter(lambda neighbor: neighbor.tp == "full-ligature", graph[node2])
            if len(neighbors2) == 0:
                continue
            
            # For each pair of neighbors that are of tp full-ligature check if they
            # are connected.
            for neighbor1 in neighbors1:
                if any([neighbor2 in full_lig_graph[neighbor1] for neighbor2 in neighbors2]):
                    graph[node1].append(node2)
                    if srfs_contactpoints(node1.srf, node2.srf, 0.1) < 3:
                        if node1 in node_to_not_adj:
                            node_to_not_adj[node1].append(node2)
                        else:
                            node_to_not_adj[node1] = [node2]
    
    # Now create the missing surfaces.
    closed = len(node_to_not_adj) * [False]  # True if a node was already in a covering event.
    missing_faces = []
    not_adj_nodes = [n for n in node_to_not_adj]
    all_subgroups = []
    not_adj_srfs = []
    for n in node_to_not_adj:
        not_adj_srfs.append([x.srf for x in node_to_not_adj[n]] + [n.srf])
    for node in not_adj_nodes:
        
        if closed[not_adj_nodes.index(node)]:
            continue
        
        # A single node might be adjacent to two missing faces. In this case we
        # need to split up its neighbors into groups.
        sub_groups = []
        neighbors = node_to_not_adj[node]
        while len(neighbors) > 0:
            queue = [neighbors[0]]
            visited = []
            while len(queue) > 0:
                curr_node = queue.pop()
                if curr_node in visited:
                    continue
                visited.append(curr_node)
                for neigh in neighbors:
                    if neigh in visited:
                        continue
                    if neigh in graph[curr_node]:
                        queue.append(neigh)
            sub_groups.append(visited)
            for vis in visited:
                neighbors.remove(vis)
        
        # Now that the subgroups have been found, we find the corners of the enclosed srfs.
        for sub_group in sub_groups:
            shared_corners = srf_shared_corners([n.srf for n in sub_group] + [node.srf])
            if len(shared_corners) < 3:
                print "here"
                continue
            """
            if not are_points_convex(shared_corners, 0.1):
                print "here"
                continue
            """
            all_subgroups.append([n.srf for n in sub_group] + [node.srf])
            new_srf = create_srf_from_points(shared_corners)
            if not new_srf:
                print "Corners lead to faulty surface."
            new_sgmt = None
            new_tp = "semi-ligature"
            new_bp = [-1]
            new_node = Node(new_sgmt, new_srf, new_tp, new_bp)
            
            # Create connection to new node.
            for neigh in sub_group + [node]:
                graph[neigh].append(new_node)
            
            # Create connections from new node to neighbors.
            graph[new_node] = sub_group + [node]
            
            # Mutually disconnect old neighbors.
            for n1 in sub_group + [node]:
                for n2 in sub_group + [node]:
                    while n2 in graph[n1]:
                        graph[n1].remove(n2)
            
            # TODO: don't forget to mark nodes.
            missing_faces.append(new_srf)
            for n in sub_group:
                closed[not_adj_nodes.index(n)] = True
        closed[not_adj_nodes.index(node)] = True
    
    return th.list_to_tree(all_subgroups), th.list_to_tree(not_adj_srfs)


def srf_shared_corners(srfs):
    corners = [srf.DuplicateVertices() for srf in srfs]
    shared_corners = []
    for i in range(len(corners)):
        for j in range(i + 1, len(corners)):
            corners1 = corners[i]
            corners2 = corners[j]
            for I in range(len(corners1)):
                for J in range(len(corners2)):
                    c1 = corners1[I]
                    c2 = corners2[J]
                    if rs.Distance(c1, c2) < 0.1:
                        shared_corners.append(c1)
    return shared_corners


def srfs_contactpoints(srf1, srf2, tol):
    # Checking for overlaps of boundary-curves: Infinitely many contact-points.
    edges1 = srf1.DuplicateEdgeCurves()
    edges2 = srf2.DuplicateEdgeCurves()
    for e1 in edges1:
        for e2 in edges2:
            intersection = rs.CurveCurveIntersection(e1, e2)
            if not intersection:
                continue
            intersection_types = [info[0] for info in intersection]
            if 2 in intersection_types:
                return float("inf")
    
    # Checking for singular points.
    corners1 = srf1.DuplicateVertices()
    corners2 = srf2.DuplicateVertices()
    num_contact_points = 0
    for c1 in corners1:
        for c2 in corners2:
            if rs.Distance(c1, c2) < tol:
                num_contact_points += 1
    return num_contact_points


#------------------------------------------------------------------------------#
# SCRIPT START.                                                                #
#------------------------------------------------------------------------------#
script_start = time.time()

#------------------------------------------------------------------------------#
# Cleaning up inputs: Removing segments which are None (and their srfs, tps).#
#------------------------------------------------------------------------------#
print "Preprocessing inputs."
start = time.time()
medax_sgmts, convex_srfs, tps = input_preprocessing(medax_sgmts, convex_srfs, tps)
end = time.time()
print "Preprocessing inputs took " + str(end - start) + " seconds."

#------------------------------------------------------------------------------#
# Finding adjacency to branchpoints.                                           #
#------------------------------------------------------------------------------#
print "Finding adjacency to branchpoints."
start = time.time()
closest_branchpoint = branchpoint_adjacency(medax_sgmts, branch_points)
end = time.time()
print "Finding adjacency to branchpoints took " + str(end - start) + " seconds."

#------------------------------------------------------------------------------#
# Creating nodes.                                                              #
#------------------------------------------------------------------------------#
print "Creating nodes."
start = time.time()
nodes = [Node(medax_sgmts[i], convex_srfs[i], tps[i], closest_branchpoint[i]) for i in range(len(medax_sgmts))]
end = time.time()
print "Creating " + str(len(nodes)) + " nodes took " + str(end - start) + " seconds."
end = time.time()

#------------------------------------------------------------------------------#
# Removing nodes whose nodes correspond to surfaces that are not on layout.    #
#------------------------------------------------------------------------------#
print "Removing surfaces outside of layout."
start = time.time()
nodes = remove_invalid_srfs(nodes, boundary_crvs, layout_srf)
end = time.time()
print "Removing surfaces outside of layout took " + str(end - start) + " seconds."

#------------------------------------------------------------------------------#
# Creating graph.                                                              #
#------------------------------------------------------------------------------#
print "Creating graph."
start = time.time()
graph = create_graph(nodes)
end = time.time()
print "Creating graph took " + str(end - start) + " seconds."

#------------------------------------------------------------------------------#
# Merging adjacent surfaces of same type.                                      #
#------------------------------------------------------------------------------#
print "Merging adjacent surfaces of same type."
start = time.time()
merge_same_tp_nodes(graph, "normal")
merge_same_tp_nodes(graph, "semi-ligature")
end = time.time()
print "Merging surfaces took " + str(end - start) + " seconds."


#------------------------------------------------------------------------------#
# Merging nodes around ligatures.                                              #
#------------------------------------------------------------------------------#
print "Merging around ligature."
start = time.time()
try:
    merge_around_semi_ligs(graph)
except:
    pass
end = time.time()
print "Merging around ligature took " + str(end - start) + " seconds."

#------------------------------------------------------------------------------#
# Testing connectivity of subgraph consisting only of full ligatures.          #
#------------------------------------------------------------------------------#
print "Testing connectivity of subgraphs constituted by full-ligatures."
start = time.time()
full_lig_graph = create_full_lig_graph(graph)
# print "len(full_lig_graph) " + str(len(full_lig_graph))
print "Testing connectivity took " + str(end - start) + " seconds."

#------------------------------------------------------------------------------#
# Adding edges based on adjacency to full-ligatures.                           #
#------------------------------------------------------------------------------#
print "Adding edges based on adjacency to full-ligatures."
start = time.time()
#all_subgroups, not_adj_srfs = create_full_lig_edges(graph, full_lig_graph)
"""
try:
    merge_around_semi_ligs(graph)
except:
    pass
"""
end = time.time()
print "Adding edges took " + str(end - start) + " seconds."

#------------------------------------------------------------------------------#
# Creating points (nodes) and edges (lines) of the graph.                      #
#------------------------------------------------------------------------------#
print "Visualizing graph."
start = time.time()
old_nodes = nodes
segs = flatten([node.sgmt for node in old_nodes])
nodes, edges = visualize_graph(graph)
neigh_srfs = [[neigh.srf for neigh in graph[node] if neigh.srf] for node in graph if node.srf]
weird = []
for neigh in neigh_srfs:
    unique = []
    for srf in neigh:
        if not any([simple_srf_compare(srf, added) for added in unique]):
            unique.append(srf)
    weird.append(unique)
degrees = [len(neigh) for neigh in weird]
srfs = []
colors = []
for node in graph:
    srfs.append(node.srf)
    r = (0.1 + random.random() * 0.9) * 255
    g = (0.1 + random.random() * 0.9) * 255
    b = (0.1 + random.random() * 0.9) * 255
    colors.append(rs.CreateColor(r, g, b))
end = time.time()
print "Visualizing graph took " + str(end - start) + " seconds."

#------------------------------------------------------------------------------#
# SCRIPT END.                                                                  #
#------------------------------------------------------------------------------#
script_end = time.time()
print "Script ran for " + str(script_end - script_start) + " seconds."
# ---------- end createconvexpartition ----------
material_3 = CreateMaterial(Diffuse=createconvexpartition.colors, Specular=RGB(255, 255, 255), Emission=RGB(0, 0, 0), Transparency=0, Shine=0)
filter = StreamFilter(Gate=0, Stream1=createconvexpartition.srfs)
filter_2 = StreamFilter(Gate=0, Stream1=createconvexpartition.nodes)
swatch_4 = ColourSwatch(SwatchColor=RGB(0, 0, 0))

closepathtomedialaxis = CSharpScript(nodePoint3dList=nodes)  # -> out, connectingCurveList; inputs medialAxisCurveList: list of Curve, nodePoint3dList: list of Point3d
# ---------- closepathtomedialaxis: C# ----------
    List<Curve> result = new List<Curve>();
    foreach (Point3d node in nodePoint3dList)
    {
      if (node == null)
      {
        continue;
      }
      Point3d closestPoint = new Point3d();
      double minDist = double.MaxValue;
      double minParam = -1.0;
      Curve minCurve = medialAxisCurveList[0];

      // Find the closest point over all medial axis curves.
      foreach (Curve medialAxisCurve in medialAxisCurveList)
      {
        if (medialAxisCurve == null)
        {
          continue;
        }
        double closeParam;
        medialAxisCurve.ClosestPoint(node, out closeParam);
        Point3d closePoint = medialAxisCurve.PointAt(closeParam);
        double dist = node.DistanceTo(closePoint);
        if (dist < minDist)
        {
          closestPoint = closePoint;
          minDist = dist;
          minParam = closeParam;
          minCurve = medialAxisCurve;
        }
      }

      // We need to split the curve and add the split segment to the list as well.
      Curve[] splitMedialAxisCurves = minCurve.Split(minParam);
      if (splitMedialAxisCurves == null)
      {
        continue;
      }
      foreach (Curve splitCurve in splitMedialAxisCurves)
      {
        result.Add(splitCurve);
      }

      // Construct connecting curve to closest point.
      result.Add(new LineCurve(node, closestPoint));
    }
    connectingCurveList = result;
# ---------- end closepathtomedialaxis ----------
scriptpar_11 = ScriptParasite(Enable=toggle, Folder=panel)

filter_3 = StreamFilter(Gate=visualize_medial_axis)
crv_17 = Curve([filter_3, closepathtomedialaxis.connectingCurveList])
